# Grasshopper definition ant_test.gh (Grasshopper 0.9.72)
# plug-ins: Ants

panel = Panel("""s = 0
for n in n_vals:
	s += n
h_val = s""")
ants = AntsCompoent(Script=panel, Rows=Slider(2, range=0..10), NumberOfColumns=Slider(4, range=0..10))  # -> Value, List
panel_2 = Panel(ants.Value)
