# Grasshopper definition Ants Gray Scott Component.gh (Grasshopper 0.9.76)
# plug-ins: Python Interpreter, Ants

number_slider = Slider(30, range=5..50)
grgph = CreateGraphOfAGrid(Rows=number_slider, NumberOfColumns=number_slider, ConnectCorners=False)
gphpts = GraphToNodes(SpatialGraph=grgph)
cluster = Cluster(pts=gphpts)  # -> nmlzd_pts_2, width_2, height_2
lng = ListLength(List=gphpts)
random = Random(Range=Domain(0, 1), Number=lng, Seed=2)
int = Integer(random)

cluster_2 = Cluster_2(pattern=int, true_val="0.25", false_val="0.0")
v_values = Number(cluster_2)

cluster_3 = Cluster_2(pattern=int, true_val="0.5", false_val="1.0")
u_values = Number(cluster_3)

list = ValueList({"Bacteria 1": 0, "Bacteria 2": 1, "Coral": 2, "Fingerprint": 3, "Spirals": 4, "Spirals-Dense": 5, "Spirals-Fast": 6, "Unstable": 7, "Worms 1": 8, "Worms 2": 9, "Zebrafish": 10}, selected="Zebrafish")
number_slider_2 = Slider(0.037, range=0.01..0.08)
number_slider_3 = Slider(0.069, range=0.05..0.07)
number_slider_4 = Slider(0.095, range=0.01..0.2)
number_slider_5 = Slider(0.03, range=0.03..0.16)
python = PythonScript(pattern=list)  # -> out, f, k, du, dv
# ---------- python: Python ----------
keys = ["Bacteria 1","Bacteria 2","Coral","Fingerprint","Spirals","Spirals-Dense","Spirals-Fast","Unstable","Worms 1","Worms 2","Zebrafish"]
pattern = keys[pattern]
if pattern=="Bacteria 1":f,k,du,dv=0.035, 0.065, 0.16, 0.08
if pattern=="Bacteria 2":f,k,du,dv=0.035, 0.065, 0.14, 0.06
if pattern=="Coral": f,k,du,dv=0.06, 0.062, 0.16, 0.08
if pattern=="Fingerprint":f,k,du,dv=0.06, 0.062, 0.19, 0.05
if pattern=="Spirals":f,k,du,dv=0.018, 0.05, 0.10, 0.10
if pattern=="Spirals-Dense":f,k,du,dv=0.02, 0.05, 0.12, 0.08
if pattern=="Spirals-Fast":f,k,du,dv=0.02, 0.05, 0.01, 0.16
if pattern=="Unstable":f,k,du,dv=0.02, 0.055, 0.16, 0.08
if pattern=="Worms 1":f,k,du,dv=0.05, 0.065, 0.16, 0.08
if pattern=="Worms 2":f,k,du,dv=0.054, 0.063, 0.19, 0.11
if pattern=="Zebrafish":f,k,du,dv=0.035,0.06,0.16,0.08
# ---------- end python ----------
gray_scott = GrayScottEngine(
    SpatialGraph=grgph,
    UValues=u_values,
    VValues=v_values,
    FCoefficient=python.f,
    KCoefficient=python.k,
    DuCoefficient=python.du,
    DvCoefficient=python.dv,
    Timestep=Slider(1, range=1..10),
    Generations=Slider(700, range=5..1000))  # -> WU, WV
number_slider_6 = Slider(370, range=0..1000)
cir = Circle(Plane=gphpts, Radius=Slider(0.41, range=0.1..1.1))
divide = DivideCurve(Curve=cir, Count=10, Kinks=False)  # -> Points, Tangents, Parameters
genvals = GetValues(AWorld=gray_scott.WU, Generation=number_slider_6)
genvals_2 = GetValues(AWorld=gray_scott.WV, Generation=number_slider_6)
width = Number(cluster.width_2)
del = DelaunayMesh(Points=divide.Points, Plane=PlaneXY(0, 0, 0))  # -> flatten(Mesh)
bnd = Bounds(Numbers=genvals_2)
bnd_2 = Bounds(Numbers=genvals)
multiplication = Multiplication(A=Slider(1.09, range=1..1.5), B=width)
remap = RemapNumbers(Value=genvals_2, Source=bnd, Target=Domain(0, 1))  # -> Mapped, Clipped
remap_2 = RemapNumbers(Value=genvals, Source=bnd_2, Target=Domain(0, 1))  # -> Mapped, Clipped
X = UnitX(Factor=multiplication)
move = Move(Geometry=del, Motion=X)  # -> Geometry, Transform
bar_graph = BarGraph(genvals, BarColor=RGB(255, 0, 90))
gradient = Gradient(LowerLimit=0, UpperLimit=1, Parameter=remap_2.Mapped, stops=[0: RGB(255, 255, 255), 1: RGB(220, 0, 40)])
gradient_2 = Gradient(LowerLimit=0, UpperLimit=1, Parameter=remap.Mapped, stops=[0: RGB(255, 255, 255), 1: RGB(0, 0, 255)])
bar_graph_2 = BarGraph(genvals_2, BarColor=RGB(255, 0, 90))
preview = CustomPreview(Geometry=del, Shader=gradient)
preview_2 = CustomPreview(Geometry=move.Geometry, Shader=gradient_2)

# ==== cluster Cluster
pts = ClusterInput()
pts_2 = Point(pts)
bnd = Bounds2D(Coordinates=pts_2)
pdecon = Deconstruct(Point=pts_2)  # -> XComponent, YComponent, ZComponent
dedom2 = DeconstructDomain²(Domain=bnd)  # -> UComponent, VComponent
remap = RemapNumbers(Value=pdecon.XComponent, Source=dedom2.UComponent, Target=Domain(0, 1))  # -> Mapped, Clipped
remap_2 = RemapNumbers(Value=pdecon.YComponent, Source=dedom2.VComponent, Target=Domain(0, 1))  # -> Mapped, Clipped
dedomain = DeconstructDomain(Domain=dedom2.UComponent)  # -> Start, End
dedomain_2 = DeconstructDomain(Domain=dedom2.VComponent)  # -> Start, End
subtraction = Subtraction(A=dedomain.End, B=dedomain.Start)
subtraction_2 = Subtraction(A=dedomain_2.End, B=dedomain_2.Start)
pt = ConstructPoint(XCoordinate=remap.Mapped, YCoordinate=remap_2.Mapped, ZCoordinate=0)
height = Number(subtraction_2)
width = Number(subtraction)
nmlzd_pts = Point(pt)
width_2 = ClusterOutput(width)
height_2 = ClusterOutput(height)
nmlzd_pts_2 = ClusterOutput(nmlzd_pts)

# ==== cluster Cluster_2
pattern = ClusterInput()
false_val = ClusterInput()
true_val = ClusterInput()
pattern_2 = Boolean(pattern)
false_val_2 = Number(false_val)
true_val_2 = Number(true_val)
lng = ListLength(List=pattern_2)
dup = DuplicateData(Data=true_val_2, Number=lng, Order=True)
dup_2 = DuplicateData(Data=false_val_2, Number=lng, Order=True)
p_n_c = PickNChoose(Pattern=pattern_2, Stream0=dup_2, Stream1=dup)
R = ClusterOutput(p_n_c)
