# Grasshopper definition Ants Gray Scott.gh (Grasshopper 0.9.76)
# plug-ins: Python Interpreter, Decodes Python Interpreter, Ants, Picnic

number_slider = Slider(12, range=3..20)
number_slider_2 = Slider(12, range=3..20)
recgrid = Rectangular(Plane=PlaneXY(0, 0, 0), SizeX=2, SizeY=2, ExtentX=number_slider_2, ExtentY=number_slider_2)  # -> flatten(Cells), Points
hexgrid = Hexagonal(Plane=PlaneXY(0, 0, 0), Size=1, ExtentX=number_slider, ExtentY=number_slider)  # -> flatten(Cells), Points
cells = Curve(recgrid.Cells)
area = Area(Geometry=cells)  # -> Area, Centroid

# ---- group: Set up Graph
crvshp = CreateGraphFromShapes(Shapes=cells, ConnectCorners=False)
spatial_graph = SpatialGraph(crvshp)

# ---- group: normalized pts
cluster = Cluster(pts=area.Centroid)  # -> nmlzd_pts_2, width_2, height_2

# ----
num = Number([1, 1, 1, 1, 1, 1, 1, 1, 1, 1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])
decodes = DecodesPythonScript(t=num)  # -> console, u, v; inputs t: Boolean
# ---------- decodes: Python ----------
if t:
    u.put(1.00)
    v.put(0.00)
else:
    u.put(0.50)
    v.put(0.25)
# ---------- end decodes ----------
cluster_2 = Cluster_2()  # -> result_2, result

# ---- group: construct dict by associating keys with a lists of values
pf = PicnicFood(Key="u", Vals=decodes.u)
pf_2 = PicnicFood(PF=pf, Key="v", Vals=decodes.v)

# ----
panel = Panel("0.065")
panel_2 = Panel("0.08")
panel_3 = Panel("0.05")
panel_4 = Panel("0.16")

# ---- group: Run CA Model [ caution - takes time ]
python_script = PythonScript(f="0.023", k="0.077", du="0.095", dv="0.03", t=Slider(5, range=1..10))  # -> out, a
# ---------- python_script: Python ----------
import copy

def test(h_val, n_vals):
    # Example of Evaluation Code Snippet
    # Evaluates each cell per Conway's Game of Life
    # Code expects:
    #	h_val  -- the value of the home cell
    #	n_vals -- the values of the neighboring cells
    # When code has run, the value of h_val will be
    # reinserted into the value list
    
    # Set up constants and valiables
    #f, k = 0.023, 0.077
    #du, dv = 0.095, 0.03
    #t = 1.0
    #print h_val

    cur_u = h_val["u"]
    cur_v = h_val["v"]
    
    sum_u = sum([nei["u"] for nei in n_vals])
    sum_v = sum([nei["v"] for nei in n_vals])
    nei_count = len(n_vals)
    
    # apply the GrayScott reaction-diffusion algorithm
    d2 = cur_u * cur_v * cur_v
    cur_du = du *(sum_u - nei_count * cur_u) - d2
    cur_dv = dv * (sum_v - nei_count * cur_v) + d2
    nxt_u = cur_u + t * (cur_du + f * (1.0 - cur_u))
    nxt_v = cur_v + t * (cur_dv - k * cur_v)

    h_val["u"] = max(0.0,nxt_u)
    h_val["v"] = max(0.0,nxt_v)

    #print h_val
    return copy.deepcopy(h_val)
    
    
a = test
# ---------- end python_script ----------
spatial_graph_2 = SpatialGraph(spatial_graph)
ants = AntsEngine(SpatialGraph=spatial_graph_2, Script=python_script.a, Value=pf_2, Generations=Slider(50, range=0..1000))  # -> Console, AWorld
panel_5 = Panel(ants.Console)

# ----
python_script_2 = PythonScript(f="0.05", k="0.065", du="0.16", dv="0.08")  # -> out, a
# ---------- python_script_2: Python ----------
import copy

def test(h_val, n_vals):
    # Example of Evaluation Code Snippet
    # Evaluates each cell per Conway's Game of Life
    # Code expects:
    #	h_val  -- the value of the home cell
    #	n_vals -- the values of the neighboring cells
    # When code has run, the value of h_val will be
    # reinserted into the value list
    
    # Set up constants and valiables
    #f, k = 0.023, 0.077
    #du, dv = 0.095, 0.03
    t = 1.0
    #print h_val

    cur_u = h_val["u"]
    cur_v = h_val["v"]
    
    # fix the value
    for i in range(len(n_vals)):
        try:
            n_vals[i] = n_vals[i].Value
            n_vals[i]["u"] = n_vals[i]["u"].Value
            n_vals[i]["v"] = n_vals[i]["v"].Value
        except:
            pass
    sum_u = 0
    sum_v = 0
    for i in range(len(n_vals)):
        sum_u += n_vals[i]["u"].Value
        sum_v += n_vals[i]["v"].Value
    
    nei_count = len(n_vals)
    
    # apply the GrayScott reaction-diffusion algorithm
    d2 = cur_u * cur_v * cur_v
    cur_du = du *(sum_u - nei_count * cur_u) - d2
    cur_dv = dv * (sum_v - nei_count * cur_v) + d2
    nxt_u = cur_u + t * (cur_du + f * (1.0 - cur_u))
    nxt_v = cur_v + t * (cur_dv - k * cur_v)

    h_val["u"] = max(0.0,nxt_u)
    h_val["v"] = max(0.0,nxt_v)

    #print h_val
    return copy.deepcopy(h_val)
    
    
a = test
# ---------- end python_script_2 ----------

# ---- group: extract values
genvals = GetValues(AWorld=ants.AWorld, Generation=Slider(0, range=0..200))
pg = PicnicGet(PF=genvals, Key="v")
pg_2 = PicnicGet(PF=genvals, Key="u")

# ----
bar_graph = BarGraph(pg, BarColor=RGB(255, 0, 90))
cells_2 = Curve(cells)
cp = ControlPoints(Curve=cells_2)  # -> Points, Weights, Knots
del = DelaunayMesh(Points=cp.Points, Plane=PlaneXY(0, 0, 0))  # -> flatten(Mesh)
width = Number(cluster.width_2)
gradient = Gradient(LowerLimit=0, UpperLimit=1, Parameter=pg_2, stops=[0: RGB(255, 255, 255), 1: RGB(220, 0, 40)])
gradient_2 = Gradient(LowerLimit=0, UpperLimit=1, Parameter=pg, stops=[0: RGB(255, 255, 255), 1: RGB(0, 0, 255)])
decodes_2 = DecodesPythonScript(u=pg_2, v=pg)  # -> console, a; inputs u: list, v: list
# ---------- decodes_2: Python ----------
corner_colors=[Color(1),Color(0),Color(1),Color(1,0,0)]
        # make sure that we are selecting within the history

# get the value fields for the specific generation
hist_u = u
hist_v = u

# define corner colors for double interpolation
u0v0, u0v1, u1v0, u1v1 = corner_colors

# initialize a grid of points to visualize the value field
points = []

# for each x-location in the value fields:
for i in range(len(u)):
    # get u and v values at x,y
    v_val = v[i]
    u_val = u[i]
    # map the u and v values onto the color space
    v_max_col_range = Color().interpolate(u1v0,u1v1,v_val**0.5)
    v_min_col_range = Color().interpolate(u0v0,u0v1,v_val**0.5)
    uv_color = Color().interpolate(v_min_col_range, v_max_col_range, u_val**0.5)
    
    a.put(uv_color) # append point to list of points
# ---------- end decodes_2 ----------
hsl = ColourHSL(Alpha=1, Hue=0, Saturation=1, Luminance=0.5)
multiplication = Multiplication(A=Slider(1.25, range=1..1.5), B=width)
col = Colour(hsl)
X = UnitX(Factor=multiplication)
preview = CustomPreview(Geometry=del, Shader=decodes_2.a)
move = Move(Geometry=del, Motion=X)  # -> Geometry, Transform
preview_2 = CustomPreview(Geometry=move.Geometry, Shader=gradient)
move_2 = Move(Geometry=move.Geometry, Motion=X)  # -> Geometry, Transform
preview_3 = CustomPreview(Geometry=move_2.Geometry, Shader=gradient_2)

# ==== cluster Cluster
pts = ClusterInput()
pts_2 = Point(pts)
bnd = Bounds2D(Coordinates=pts_2)
pdecon = Deconstruct(Point=pts_2)  # -> XComponent, YComponent, ZComponent
dedom2 = DeconstructDomain²(Domain=bnd)  # -> UComponent, VComponent
remap = RemapNumbers(Value=pdecon.XComponent, Source=dedom2.UComponent, Target=Domain(0, 1))  # -> Mapped, Clipped
remap_2 = RemapNumbers(Value=pdecon.YComponent, Source=dedom2.VComponent, Target=Domain(0, 1))  # -> Mapped, Clipped
dedomain = DeconstructDomain(Domain=dedom2.UComponent)  # -> Start, End
dedomain_2 = DeconstructDomain(Domain=dedom2.VComponent)  # -> Start, End
subtraction = Subtraction(A=dedomain.End, B=dedomain.Start)
subtraction_2 = Subtraction(A=dedomain_2.End, B=dedomain_2.Start)
pt = ConstructPoint(XCoordinate=remap.Mapped, YCoordinate=remap_2.Mapped, ZCoordinate=0)
height = Number(subtraction_2)
width = Number(subtraction)
nmlzd_pts = Point(pt)
width_2 = ClusterOutput(width)
height_2 = ClusterOutput(height)
nmlzd_pts_2 = ClusterOutput(nmlzd_pts)

# ==== cluster Cluster_2
A = ClusterInput()
subtraction = Subtraction(A=A, B=1)
absolute = Absolute(Value=subtraction)
division = Division(A=absolute, B=2)
division_2 = Division(A=absolute, B=4)
B = ClusterInput()
addition = Addition(A=division, B=B)
result = ClusterOutput(division_2)
result_2 = ClusterOutput(addition)
