# Grasshopper definition GrayScott.gh (Grasshopper 0.9.76)
# plug-ins: Python Interpreter, Decodes Python Interpreter, Ants

pixel_height = Panel("20")
pixel_width = Panel("20")
pixel_height_2 = Integer(pixel_height)
pixel_width_2 = Integer(pixel_width)

# ---- group: Set up Graph
pixel_width_3 = Integer(pixel_width_2)
pixel_height_3 = Integer(pixel_height_2)
grgph = CreateGraphOfAGrid(Rows=pixel_width_3, NumberOfColumns=pixel_height_3, ConnectCorners=Toggle(True))
gphpts = GraphToNodes(SpatialGraph=grgph)
sg = SpatialGraph(grgph)
graph_points = Point(gphpts)

# ---- group: set seed condition
rectangle = Rectangle(Plane=PlaneXY(2, 2, 0), XSize=Domain(-1, 1), YSize=Slider(2.81, range=1..10), Radius=0)  # -> Rectangle, Length
rectangle_2 = Rectangle(Plane=PlaneXY(4.968529551, 14.23529415, 0), XSize=Slider(10, range=1..10), YSize=Domain(-2, 2), Radius=0)  # -> Rectangle, Length
cluster = Cluster(graph_points=graph_points, crv=[rectangle.Rectangle, rectangle_2.Rectangle])

# ---- group: Cell Behavior
python = PythonScript(seeds=cluster)  # -> out, a, b; inputs seeds: list of Boolean
# ---------- python: Python ----------
import random, copy

step_size = 2.0

class Cell():
    def __init__(self, u = None, v = None, seed = None):
        self.coeff = {"f":0.023,"k":0.077,"du":0.095,"dv":0.03}
        self.prop_u = u
        self.prop_v = v
        if u is None or v is None:
            if seed: self.set_seed()
            else: self.set_blank()
        
    def set_blank(self):
        self.prop_u = 1.0
        self.prop_v = 0.0 # good 'blank' values
        
    def set_seed(self):
        self.prop_u = 0.5
        self.prop_v = 0.25 # good 'seed' values
        
    def eval(self,neighbors):
        # next = copy.copy(self)
        # get u- and v- values for this cell 
        cur_u = self.prop_u
        cur_v = self.prop_v
        
        # get the neighbors of this cell
        nei_u = sum([nei.prop_u for nei in neighbors])
        nei_v = sum([nei.prop_v for nei in neighbors])
        
        # apply the GrayScott reaction-diffusion algorithm
        d2 = cur_u * cur_v * cur_v
        cur_du = self.coeff['du'] * (nei_u - 4.0 * cur_u) - d2
        cur_dv = self.coeff['dv'] * (nei_v - 4.0 * cur_v) + d2
        nxt_u = cur_u + step_size * (cur_du + self.coeff['f'] * (1.0 - cur_u))
        nxt_v = cur_v + step_size * (cur_dv - self.coeff['k'] * cur_v)
        
        # ensure that values are positive 
        nxt_u = max(0.0,nxt_u)
        nxt_v = max(0.0,nxt_v)
        
        return Cell(nxt_u,nxt_v)
        
        
    def __repr__(self):
        return '(u:{0},v:{1})'.format(self.prop_u,self.prop_v)
        
b = [Cell(seed=s) for s in seeds]
a = Cell.eval
# ---------- end python ----------

# ----
ants = AntsEngine(SpatialGraph=sg, Script=python.a, Value=python.b, Generations=Slider(100, range=0..100))  # -> Console, AWorld
aworld = AntsWorld(ants.AWorld)
panel = Panel(ants.Console)
genvals = GetValues(AWorld=aworld, Generation=Slider(0, range=0..100))

# ---- group: decompose Cells
python_2 = PythonScript(cells=genvals)  # -> out, prop_u, prop_v; inputs cells: list
# ---------- python_2: Python ----------
max = 1000
prop_u = [min(cell.prop_u,max) for cell in cells]
prop_v = [min(cell.prop_v,max) for cell in cells]
# ---------- end python_2 ----------

# ----
bnd = Bounds(Numbers=python_2.prop_v)
bnd_2 = Bounds(Numbers=python_2.prop_u)
panel_2 = Panel([bnd_2, bnd])
u0v0 = ColourSwatch(SwatchColor=RGB(0, 0, 0))
u0v1 = ColourSwatch(SwatchColor=RGB(255, 0, 0))
u1v1 = ColourSwatch(SwatchColor=RGB(0, 0, 0))
u1v0 = ColourSwatch(SwatchColor=RGB(255, 255, 255))
decodes = DecodesPythonScript(prop_u=python_2.prop_u, prop_v=python_2.prop_v, u0v0=u0v0, u0v1=u0v1, u1v0=u1v0, u1v1=u1v1)  # -> console, a; inputs prop_u: list, prop_v: list
# ---------- decodes: Python ----------
"""
Creates a set of points representing the state of the model at a given time.
"""
# setup argument dict for color interpolation
intrp_args = {"u0v0":u0v0,"u0v1":u0v1,"u1v0":u1v0,"u1v1":u1v1}

def uv_to_color(n):
    # get u and v values at x,y
    intrp_args['u'] = prop_u[n]
    intrp_args['v'] = prop_v[n]
    
    # map the u and v values onto the color space
    return Color().interpolate2d(**intrp_args)
    
a.put([uv_to_color(n) for n in range(len(prop_u))])
# ---------- end decodes ----------
graph_points_2 = Point(graph_points)
rectangle_3 = Rectangle(Plane=graph_points_2, XSize=Domain(-0.5, 0.5), YSize=Domain(-0.5, 0.5), Radius=0)  # -> Rectangle, Length
cp = ControlPoints(Curve=rectangle_3.Rectangle)  # -> Points, Weights, Knots
del = DelaunayMesh(Points=cp.Points, Plane=PlaneXY(0, 0, 0))  # -> flatten(Mesh)
preview = CustomPreview(Geometry=del, Shader=decodes.a)

# ==== cluster Cluster
crv = ClusterInput()
graph_points = ClusterInput()
crv_2 = Curve(crv)
graph_points_2 = Point(graph_points)
incurves = PointInCurves(Point=graft(graph_points_2), Curves=crv_2)  # -> flatten(Relationship), Index, Point
larger = LargerThan(FirstNumber=incurves.Relationship, SecondNumber=0)  # -> LargerThan, OrEqualTo
bool = Boolean(larger.LargerThan)
bool_2 = ClusterOutput(bool)
