# Grasshopper definition Selection_Tester.gh (Grasshopper 0.9.72)
# plug-ins: Ants

test = Panel("""h_val =  any([v==2.0 for v in n_vals])
print h_idx, n_vals, h_val""")
number_slider = Slider(3, range=0..10)
multiplication = Multiplication(A=number_slider, B=number_slider)
random = Random(Range=Domain(0, 2), Number=multiplication, Seed=2)
test_2 = Panel("print h_idx, n_vals,\"yo!\"")
hexgrid = Hexagonal(Plane=PlaneXY(0, 0, 0), Size=1, ExtentX=5, ExtentY=5)  # -> flatten(Cells), Points
round = Round(Number=random)  # -> Nearest, Floor, Ceiling
grgph = CreateGraphOfAGrid(Rows=number_slider, NumberOfColumns=number_slider, ConnectCorners=Toggle(False))
crvshp = CreateGraphFromShapes(Shapes=hexgrid.Cells, ConnectCorners=False)
gphln = GraphToEdges(SpatialGraph=crvshp)
ants = AntsEngine2(
    SpatialGraph=grgph,
    SelectionScript=test,
    OneOrAll=Toggle(True),
    EvalScript=test_2,
    Value=round.Ceiling,
    Generations=Slider(10, range=0..10))  # -> Console, AWorld
panel = Panel(ants.Console)
