# Grasshopper definition ants_life_2.gh (Grasshopper 0.9.72)
# plug-ins: Ants

game_of_life = Panel("""# Example of Evaluation Code Snippet
# Evaluates each cell per Conway's Game of Life
# Code expects:
#	h_val  -- the value of the home cell
#	n_vals -- the values of the neighboring cells
# When code has run, the value of h_val will be
# reinserted into the value list

# Set up constants and valiables
val_on = 1.0
val_off = 0.0
count = 0

# for each cell in the neighborhood:
for i in n_vals:
    # if cell is True:
    if i >= val_on: 
        count += 1 # count it
        
# if home cell is ON:
if h_val >= val_on:
    # if less than 2 or more than 3 neighbors are ON:
    if (count < 2) or (count >3) :
        # this cell will be OFFe in the next generation
        h_val = val_off
    # else:
    else:
        # this cell will be ON in the next generation
        h_val = val_on
# else the home cell is OFF:
else:
    # if exactly 3 neighbors are ON:
    if (count == 3):
        # this cell will be ON in the next generation
        h_val = val_on
    else:
        # else this cell will be False in the next generation
        h_val = val_off

# Anything printed will show up in the console if
# a panel is attached to the ... output of the Ants
# component
print h_val, count, n_vals""")
life_code = Text(game_of_life)
number_slider = Slider(1, range=0..1)
number_slider_2 = Slider(8, range=0..100)
multiplication = Multiplication(A=number_slider, B=2)
division = Division(A=multiplication, B=number_slider_2)
series = Series(Start=expr("-x", number_slider), Step=division, Count=expr("x+1", number_slider_2))
Z = UnitZ(Factor=series)
lifeworld = AntsWorld({edges="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", gens="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", igen="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", nodes="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", weights="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"})
rectangle = Rectangle(Plane=Z, XSize=Domain(-1, 1), YSize=Domain(-2, 2), Radius=0)  # -> Rectangle, Length
loft = Loft(
    Curves=rectangle.Rectangle,
    Options={Adjust=False, Closed=False, LoftEnds=0, LoftSimp=0, LoftType=0, Rebuild=10, Refit=0.01})
loft_2 = Loft(
    Curves=rectangle.Rectangle,
    Options={Adjust=False, Closed=False, LoftEnds=0, LoftSimp=0, LoftType=0, Rebuild=10, Refit=0.01})
number_slider_3 = Slider(7.24, range=0..10)  # disabled
number_slider_4 = Slider(0.01, range=0..10)  # disabled

# ---- group: create starting position
pixel_width = Panel("40")
pixel_height = Panel("40")
pixel_height_2 = Integer(pixel_height)
pixel_width_2 = Integer(pixel_width)

# ---- group: Set up Graph
pixel_width_3 = Integer(pixel_width)
pixel_height_3 = Integer(pixel_height)
grgph = CreateGraphOfAGrid(Rows=pixel_width_3, NumberOfColumns=pixel_height_3, ConnectCorners=Toggle(True))
gphpts = GraphToNodes(SpatialGraph=grgph)
sg = SpatialGraph(grgph)
pt = Point(gphpts)

# ---- group: create starting position
pixel_height_4 = Integer(pixel_height)
pixel_width_4 = Integer(pixel_width)
cluster = Cluster(B_2=pixel_width_4, B=pixel_height_4)
image = ImageSampler(
    cluster,
    FilePath="C:\Users\Ned Reifenstein\Documents\GitHub\decodes\sandbox\_nr_sandbox\studio\game_of_life_01_40x40.png",
    Filter="Red",
    Interpolate=False,
    Umax=40,
    Umin=1,
    Vmax=40,
    Vmin=1,
    Wrap=1)

addition = Addition(A=image, B=1)
mod = Modulus(A=addition, B=2)
bitmap = Data(mod)

# ----
bitmap_2 = Data(bitmap)
lng = ListLength(List=bitmap_2)
random = Random(Range=Domain(0, 1), Number=lng, Seed=2)
round = Round(Number=random)  # -> Nearest, Floor, Ceiling
alternate = Data(round.Nearest)
alternate_2 = Data(alternate)

# ---- group: Run CA Model [ caution - takes time ]
life_code_2 = Text(life_code)
sg_2 = SpatialGraph(sg)
bitmap_3 = Data(bitmap)
ants = AntsCompoent(SpatialGraph=sg_2, Script=life_code_2, Value=alternate_2, Generations=Slider(50, range=0..100))  # -> Console, AWorld
aworld = AntsWorld(ants.AWorld)
panel = Panel(ants.Console)

# ---- group: Visualize Results
aworld_2 = AntsWorld(aworld)
genvals = GetValues(AWorld=lifeworld, Generation=Slider(8, range=0..100))
pt_2 = Point(pt)

# ----
equals = Equality(FirstNumber=genvals, SecondNumber="1")  # -> Equality, Inequality
cull = CullPattern(List=pt_2, CullPattern=equals.Equality)

# ---- group: Visualize Results (continued)
cir = Circle(Plane=cull, Radius=expr("x/2", "1"))

# ----
metaball_t = MetaBallT(Points=cull, Plane=PlaneXY(0, 0, 0), Threshold=number_slider_3, Accuracy=number_slider_4)  # disabled
metaball_t_2 = MetaBallT(Points=cull, Plane=Z, Threshold=Slider(3.75, range=0..10), Accuracy=Slider(0.01, range=0..10))
boundary = BoundarySurfaces(Edges=metaball_t)  # disabled
boundary_2 = BoundarySurfaces(Edges=metaball_t_2)  # disabled

# ==== cluster Cluster
B = ClusterInput()
B_2 = ClusterInput()
dom = ConstructDomain(DomainStart=1, DomainEnd=B)
dom_2 = ConstructDomain(DomainStart=1, DomainEnd=B_2)
range = Range(Domain=dom, Steps=dom)
range_2 = Range(Domain=dom_2, Steps=dom_2)
crossref = CrossReference(ListA=range_2, ListB=range, CrossMode=1)  # -> ListA, ListB
pt = ConstructPoint(XCoordinate=crossref.ListA, YCoordinate=crossref.ListB, ZCoordinate=0)
pt_2 = ClusterOutput(pt)
