# Grasshopper definition ants_maze_solver.gh (Grasshopper 0.9.72)
# plug-ins: Ants

maze_solver = Panel("""val_corr = 1.0
val_wall = 0.0
count = 0

# for each cell in the neighborhood:
for i in n_vals:
    # if cell is True:
    if i == val_wall: 
        count += 1 # count it

if (len(n_vals) > 3) and (h_val == val_corr):
    # if cell is True:
    if count > 2: 
        h_val = val_wall

print h_val, count, n_vals""")
eval_maze = Text(maze_solver)

pixel_width = Panel("19")
pixel_height = Panel("19")
pixel_height_2 = Integer(pixel_height)
pixel_width_2 = Integer(pixel_width)

# ---- group: make graph
pixel_height_3 = Integer(pixel_height)
pixel_width_3 = Integer(pixel_width)
grgph = CreateGraphOfAGrid(Rows=pixel_width_3, NumberOfColumns=pixel_height_3, ConnectCorners=Toggle(False))
gphpts = GraphToNodes(SpatialGraph=grgph)
pt = Point(gphpts)
sg = SpatialGraph(grgph)

# ----
pixel_height_4 = Integer(pixel_height)
pixel_width_4 = Integer(pixel_width)
cluster = Cluster(B_2=pixel_width_4, B=pixel_height_4)

image = ImageSampler(
    cluster,
    FilePath="C:\Users\Ned Reifenstein\Documents\GitHub\ants\gh\images\drmaze4.jpg",
    Filter="Red",
    Interpolate=False,
    Umax=19,
    Umin=1,
    Vmax=19,
    Vmin=1,
    Wrap=1)
round = Round(Number=image)  # -> Nearest, Floor, Ceiling
bitmap = Data(round.Nearest)

# ---- group: evaluate CA
_0 = Slider(45, range=0..100)
eval_maze_2 = Text(eval_maze)
bitmap_2 = Data(bitmap)
sg_2 = SpatialGraph(sg)
ants = AntsEngine(SpatialGraph=sg_2, Script=eval_maze_2, Value=bitmap_2, Generations=_0)  # -> Console, AWorld

# ---- group: display paths at last Generation
genvals = GenerationValues(AWorld=ants.AWorld, Generation=_0)
pt_2 = Point(pt)
equals = Equality(FirstNumber=genvals, SecondNumber=0)  # -> Equality, Inequality
cull = CullPattern(List=pt_2, CullPattern=equals.Inequality)
box = CenterBox(Base=cull, X=".5", Y=".5", Z=".5")
col = Colour(RGB(156, 199, 171))
preview = CustomPreview(Geometry=box, Shader=col)

# ---- group: display walls only at Generation 0
genvals_2 = GenerationValues(AWorld=ants.AWorld, Generation="0")
pt_3 = Point(pt)
equals_2 = Equality(FirstNumber=genvals_2, SecondNumber=0)  # -> Equality, Inequality
cull_2 = CullPattern(List=pt_3, CullPattern=equals_2.Equality)
box_2 = CenterBox(Base=cull_2, X=".5", Y=".5", Z=".5")

# ==== cluster Cluster
B = ClusterInput()
B_2 = ClusterInput()
dom = ConstructDomain(DomainStart=1, DomainEnd=B)
dom_2 = ConstructDomain(DomainStart=1, DomainEnd=B_2)
range = Range(Domain=dom, Steps=dom)
range_2 = Range(Domain=dom_2, Steps=dom_2)
crossref = CrossReference(ListA=range_2, ListB=range, CrossMode=1)  # -> ListA, ListB
pt = ConstructPoint(XCoordinate=crossref.ListA, YCoordinate=crossref.ListB, ZCoordinate=0)
pt_2 = ClusterOutput(pt)
