# Grasshopper definition ants_test.gh (Grasshopper 0.9.72)
# plug-ins: Ants

aworld = AntsWorld({edges="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", GenCount="2", gens="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", nodes="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", type="Boolean", weights="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"})

# ---- group: Visualize Results
aworld_2 = AntsWorld()
genvals = GetValues(AWorld=aworld, Generation=Slider(0, range=0..100))
pt = Point([Point(0, 0, 0), Point(1, 0, 0), Point(2, 0, 0), Point(3, 0, 0), Point(4, 0, 0), Point(5, 0, 0)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])

# ----
cull = CullPattern(List=pt, CullPattern=genvals)

# ---- group: Visualize Results (continued)
cir = Circle(Plane=cull, Radius=expr("x/2", 1))
