# Grasshopper definition antworld_mesh_average.gh (Grasshopper 0.9.72)
# plug-ins: Ants

v = Data(Slider(30, range=3..100))
u = Data(Slider(30, range=3..100))

# ---- group: First Source Mesh
geo = Geometry([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])
loft = Loft(Curves=geo, Options={Adjust=False, Closed=False, LoftEnds=0, LoftSimp=0, LoftType=0, Rebuild=10, Refit=0.01})
mesh_uv = MeshSurface(Surface=loft, UCount=u, VCount=v, Overhang=True, Equalize=False)

# ----
mesh = Mesh(mesh_uv)

# ---- group: Second Source Mesh
cluster = Cluster(M=mesh)  # -> M_2, V, F

# ----
mesh_2 = Mesh(cluster.M_2)

# ---- group: Create Values from Z coords
demesh = DeconstructMesh(Mesh=cluster.M_2)  # -> Vertices, Faces, Colours, Normals
pdecon = Deconstruct(Point=cluster.V)  # -> XComponent, YComponent, ZComponent
pdecon_2 = Deconstruct(Point=demesh.Vertices)  # -> XComponent, YComponent, ZComponent
subtraction = Subtraction(A=pdecon_2.ZComponent, B=pdecon.ZComponent)

# ----
average_rule = Panel("""val_on = 1.0
val_off = 0.0
sum = h_val

# for each cell in the neighborhood:
for i in n_vals:
    # if cell is True:
    sum += i
        
h_val = sum /(len(n_vals)+1.0)

print h_val, count, n_vals""")
v_2 = Data(v)
u_2 = Data(u)
gridworld = AntsGridWorld(Rows=u_2, NumberOfColumns=v_2, Value=subtraction, ConnectCorners=False)
ants = AntsCompoent(AWorld=gridworld, Script=average_rule, Generations=Slider(46, range=0..100))  # -> Console, AWorld
genvals = GenerationValues(AWorld=ants.AWorld, Generation=Slider(7, range=0..100))
Z = UnitZ(Factor=genvals)
move = Move(Geometry=cluster.V, Motion=Z)  # -> Geometry, Transform
conmesh = ConstructMesh(Vertices=move.Geometry, Faces=cluster.F)

# ==== cluster Cluster
M = ClusterInput()
demesh = DeconstructMesh(Mesh=M)  # -> Vertices, Faces, Colours, Normals
lng = ListLength(List=demesh.Normals)
V = ClusterOutput(demesh.Vertices)
F = ClusterOutput(demesh.Faces)
random = Random(Range=Slider(3.8, range=0..10), Number=lng, Seed=2)
Z = UnitZ(Factor=random)
move = Move(Geometry=demesh.Vertices, Motion=Z)  # -> Geometry, Transform
conmesh = ConstructMesh(Vertices=move.Geometry, Faces=demesh.Faces)
M_2 = ClusterOutput(conmesh)
