# Grasshopper definition antworld_test.gh (Grasshopper 0.9.72)
# plug-ins: Ants

# creates a border: if len(n_vals)==4: h_val = 0.5
# elif len(n_vals)==2: h_val = 0.5
# else: h_val = 0.1
random = Panel("""import random
h_val = random.randint(0,1)""")
# test: print h_idx, n_vals
# if any([v>3.0 for v in n_vals]):
#     h_val = 1
# else:
#     h_val = 0
game_of_life = Panel("""val_on = 1.0
val_off = 0.0
count = 0

# for each cell in the neighborhood:
for i in n_vals:
    # if cell is True:
    if i >= val_on: 
        count += 1 # count it
        
# if home cell is True:
if h_val >= val_on:
    # if less than 2 or more than 3 neighbors are True:
    if (count < 2) or (count >3) :
        # this cell will be False in the next generation
        h_val = val_off
    # else:
    else:
        # this cell will be True in the next generation
        h_val = val_on
# else the home cell is False:
else:
    # if exactly 3 neighbors are True:
    if (count == 3):
        # this cell will be True in the next generation
        h_val = val_on
    else:
        # else this cell will be False in the next generation
        h_val = val_off

print h_val, count, n_vals""")
func_a = Text(random)
func_b = Text(game_of_life)
number_slider = Slider(15, range=2..30)
number_slider_2 = Slider(15, range=2..30)
multiplication = Multiplication(A=number_slider, B=number_slider_2)
random_2 = Random(Range=Domain(0, 1), Number=multiplication, Seed=2)
round = Round(Number=random_2)  # -> Nearest, Floor, Ceiling
gridworld = AntsGridWorld(Rows=number_slider, NumberOfColumns=number_slider_2, Value="0.05")
func_a_2 = Text(func_a)
ants = AntsCompoent(AWorld=gridworld, Script=random, Generations=Slider(1, range=0..10), Value=round.Nearest)  # -> Console, AWorld, AWorld_2
getedges = GetEdges(AWorld=gridworld)
func_b_2 = Text(func_b)
panel = Panel(ants.AWorld)
panel_2 = Panel(ants.Console)
ants_2 = AntsCompoent(AWorld=ants.AWorld, Script=func_b_2, Generations=Slider(10, range=0..10), Value=round.Nearest)  # -> Console, AWorld, AWorld_2
number_slider_3 = Slider(10, range=0..10)
genvals = GenerationValues(AWorld=ants_2.AWorld, Generation=number_slider_3)
path = ConstructPath(Indices=number_slider_3)
branch = TreeBranch(Path=path, MaintainPaths=True)
panel_3 = Panel(ants_2.AWorld)
panel_4 = Panel(ants_2.Console)
cir = Circle(Plane=PlaneXY(0, 0, 0), Radius=expr("x/2", branch))
panel_5 = Panel(genvals)
