# Grasshopper definition antworld_test_nr.gh (Grasshopper 0.9.72)
# plug-ins: Decodes Python Interpreter, Ants

# creates a border: if len(n_vals)==4: h_val = 0.5
# elif len(n_vals)==2: h_val = 0.5
# else: h_val = 0.1
# print h_val
# creates a border: if len(n_vals) < 4: h_val = 0.5
# elif len(n_vals)< 8: h_val = 1.0
# else: h_val = 10.0
# print h_val
diagnostic = Panel("""h_val = h_val
print h_val, len(n_vals)""")
# random: import random
# h_val = random.randint(0,1)
game_of_life = Panel("""val_on = 1.0
val_off = 0.0
count = 0

# for each cell in the neighborhood:
for i in n_vals:
    # if cell is True:
    if i >= val_on: 
        count += 1 # count it
        
# if home cell is True:
if h_val >= val_on:
    # if less than 2 or more than 3 neighbors are True:
    if (count < 2) or (count >3) :
        # this cell will be False in the next generation
        h_val = val_off
    # else:
    else:
        # this cell will be True in the next generation
        h_val = val_on
# else the home cell is False:
else:
    # if exactly 3 neighbors are True:
    if (count == 3):
        # this cell will be True in the next generation
        h_val = val_on
    else:
        # else this cell will be False in the next generation
        h_val = val_off

print h_val, count, n_vals""")

# ----
# a
pixel_width = Panel("40")
pixel_height = Panel("40")
pixel_height_2 = Integer(pixel_height)
panel = Panel("create starting position")
pixel_width_2 = Integer(pixel_width)

pixel_height_3 = Integer(pixel_height)
pixel_width_3 = Integer(pixel_width)
cluster = Cluster(B_2=pixel_width_3, B=pixel_height_3)
image = ImageSampler(
    cluster,
    FilePath="C:\Users\Ned Reifenstein\Documents\GitHub\decodes\sandbox\_nr_sandbox\studio\game_of_life_01_40x40.png",
    Filter="Red",
    Interpolate=False,
    Umax=40,
    Umin=1,
    Vmax=40,
    Vmin=1,
    Wrap=1)

pixel_width_4 = Integer(pixel_width)
pixel_height_4 = Integer(pixel_height)
decodes = DecodesPythonScript(w=pixel_width_4, h=pixel_height_4)  # -> console, f_out; inputs w: Int32, h: Int32
# ---------- decodes: Python ----------
black = Color(0.0,0.0,0.0)
white = Color(1.0,1.0,1.0)


# initialize an instance of the CA object class
start_field = ValueField(Interval(w,h),include_corners = True,wrap = False)
# random.seed(0)

# for every pixel in the boolean field:
for i in range(w*h):
    start_field._pixels[i] = random.choice([black, white]) # randomly select black or white

f_out.put(start_field)
# ---------- end decodes ----------

func_a = Text(diagnostic)
# test: print h_idx, n_vals
# if any([v>3.0 for v in n_vals]):
#     h_val = 1
# else:
#     h_val = 0
func_b = Text(game_of_life)
range = Range(Domain=Domain(0, 8), Steps=8)
pixel_height_5 = Integer(pixel_height)
decodes_2 = DecodesPythonScript()  # -> console, a
# ---------- decodes_2: Python ----------
a.put([0,0,0,1,1,1,0,0,0])
# ---------- end decodes_2 ----------
pixel_width_5 = Integer(pixel_width)
addition = Addition(A=image, B=1)
panel_2 = Panel("0.05")
mod = Modulus(A=addition, B=2)
func_a_2 = Text(func_a)
func_b_2 = Text(func_b)
bitmap = Data(mod)
bitmap_2 = Data(bitmap)
gridworld = AntsGridWorld(Rows=pixel_width_5, NumberOfColumns=pixel_height_5, Value=bitmap_2, ConnectCorners=Toggle(True))
ants = AntsCompoent(AWorld=gridworld, Script=func_a_2, Generations=Slider(1, range=0..10))  # -> Console, AWorld
getedges = GetEdges(AWorld=gridworld)  # disabled
panel_3 = Panel(ants.AWorld)
ants_2 = AntsCompoent(AWorld=gridworld, Script=func_b_2, Generations=Slider(50, range=0..100))  # -> Console, AWorld
aworld = AntsWorld(ants_2.AWorld)
panel_4 = Panel(ants.Console)
genvals = GenerationValues(AWorld=aworld, Generation=Slider(0, range=0..10))
getedges_2 = GetEdges(AWorld=aworld)
getnodes = GetNodes(AWorld=aworld)  # -> Points, Values; disabled
panel_5 = Panel(ants_2.AWorld)
panel_6 = Panel(ants_2.Console)
pt = Point([Point(0, 0, 0), Point(1, 0, 0), Point(2, 0, 0), Point(3, 0, 0), Point(4, 0, 0), Point(5, 0, 0)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])
cir = Circle(Plane=pt, Radius=expr("x/2", genvals))

# ==== cluster Cluster
B = ClusterInput()
B_2 = ClusterInput()
dom = ConstructDomain(DomainStart=1, DomainEnd=B)
dom_2 = ConstructDomain(DomainStart=1, DomainEnd=B_2)
range = Range(Domain=dom, Steps=dom)
range_2 = Range(Domain=dom_2, Steps=dom_2)
crossref = CrossReference(ListA=range_2, ListB=range, CrossMode=1)  # -> ListA, ListB
pt = ConstructPoint(XCoordinate=crossref.ListA, YCoordinate=crossref.ListB, ZCoordinate=0)
pt_2 = ClusterOutput(pt)
