# Grasshopper definition change_nodes_tester.gh (Grasshopper 0.9.72)
# plug-ins: Ants

number_slider = Slider(3, range=0..10)
multiplication = Multiplication(A=number_slider, B=number_slider)
xy = XYPlane(Origin=Point(0, 0, 0))
grgph = CreateGraphOfAGrid(Rows=number_slider, NumberOfColumns=number_slider, ConnectCorners=False)
circle = CircleCNR(Center=xy, Normal=Vector(0, 0, 1), Radius=Slider(20, range=0..100))
gphln = GraphToEdges(SpatialGraph=grgph)
gphpts = GraphToNodes(SpatialGraph=grgph)
divide = DivideCurve(Curve=circle, Count=multiplication, Kinks=False)  # -> Points, Tangents, Parameters
chpts = ChangeNodesOfAGraph(SpatialGraph=grgph, Points=divide.Points)
gphln_2 = GraphToEdges(SpatialGraph=chpts)
