# Grasshopper definition gc_tester.gh (Grasshopper 0.9.72)
# plug-ins: Ants

sg = SpatialGraph({edges="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", nodes="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", weights="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"})
data = Data()
aworld = AntsWorld({edges="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", GenCount="20", gens="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", nodes="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", type="Point3d", weights="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"})
aworld_2 = AntsWorld({edges="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", GenCount="20", gens="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", nodes="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", type="Point3d", weights="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"})
genvals = GetValues(AWorld=aworld, Generation=Slider(0, range=0..100))
chpts = ChangeNodesOfAGraph(SpatialGraph=sg, Points=genvals)
pt = Point(genvals)
gphln = GraphToEdges(SpatialGraph=chpts)
