# Grasshopper definition graph_testers.gh (Grasshopper 0.9.72)
# plug-ins: Ants

number_slider = Slider(2, range=0..10)
ptsgph = CreateGraphFromPoints(Dist=1)
grgph = CreateGraphOfAGrid(Rows=number_slider, NumberOfColumns=number_slider, ConnectCorners=Toggle(True))
sgraph = SpatialGraph(grgph)
ants = AntsCompoent(SpatialGraph=sgraph, Script="h_val = h_val -1", Value=Slider(0, range=0..100), Generations=Slider(5, range=0..10))  # -> Console, AWorld
getnodes = GetNodes(SpatialGraph=sgraph)
graphtoedges = GraphToEdges(SpatialGraph=sgraph)
