# Grasshopper definition graphbypoints_tester.gh (Grasshopper 0.9.72)
# plug-ins: Ants

hexgrid = Hexagonal(Plane=PlaneXY(0, 0, 0), Size=1, ExtentX=5, ExtentY=5)  # -> flatten(Cells), flatten(Points)
number_slider = Slider(7, range=0..100)  # disabled
geo = Geometry([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])
geo_2 = Geometry([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])
pt = Point(Point(9.3, 0, 0))
geo_3 = Geometry([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])
geo_4 = Geometry([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])
explode = Explode(Curve=hexgrid.Cells, Recursive=True)  # -> flatten(Segments), Vertices
pt_2 = Point(Point(-20.9, -9.6, 0))  # disabled
number_slider_2 = Slider(20, range=0..100)  # disabled
geo_5 = Geometry([<curve referenced from the Rhino model> x2])
number_slider_3 = Slider(0.3, range=0..1)  # disabled
sqgrid = Square(Plane=pt, Size=1, ExtentX=5, ExtentY=5)  # -> flatten(Cells), Points
box = CenterBox(Base=pt_2, X=number_slider, Y=number_slider, Z=number_slider)  # disabled
number_slider_4 = Slider(5, range=0..10)  # disabled
lnsgph = CreateGraphFromLines(Lines=explode.Segments)
number_slider_5 = Slider(8.131, range=0..50)  # disabled
pop3d = Populate3D(Region=box, Count=number_slider_2, Seed=number_slider_3)  # disabled
crvgph = CreateGraphFromCurves(Curves=sqgrid.Cells, ConnectCorners=Toggle(False))
number_slider_6 = Slider(1.9, range=0..10)  # disabled
data = Data(pop3d)  # disabled
sqgrid_2 = Square(Plane=PlaneXY(0, 0, 0), Size=1, ExtentX=number_slider_4, ExtentY=number_slider_4)  # -> Cells, flatten(Points); disabled
gphln = GraphToEdges(SpatialGraph=crvgph)
gphexp = GraphExplorer(SpatialGraph=lnsgph, IndexOfNode=Slider(34, range=0..40))  # -> Points, Neighbors, Edges, Weights
number_slider_7 = Slider(15, range=0..50)  # disabled
ptsgph = CreateGraphFromPoints(Points=data, Dist=number_slider_5)  # disabled
ptsgph_2 = CreateGraphFromPoints(Points=sqgrid_2.Points, Dist=number_slider_6)  # disabled
panel = Panel(crvgph)
sph = Sphere(Base=gphexp.Points, Radius=0.5)
sg = SpatialGraph(ptsgph)  # disabled
panel_2 = Panel(gphexp.Neighbors)
pipe = Pipe(Curve=gphexp.Edges, Radius=0.2, Caps=0)
gphexp_2 = GraphExplorer(SpatialGraph=sg, IndexOfNode=number_slider_7)  # -> Points, Neighbors, Edges, Weights; disabled
gphln_2 = GraphToEdges(SpatialGraph=sg)  # disabled
panel_3 = Panel(gphexp.Weights)
sph_2 = Sphere(Base=gphexp_2.Points, Radius=0.5)  # disabled
panel_4 = Panel(gphexp_2.Neighbors)  # disabled
panel_5 = Panel(gphexp_2.Weights)  # disabled
pipe_2 = Pipe(Curve=gphexp_2.Edges, Radius=0.2, Caps=0)  # disabled
