# Grasshopper definition gscott_tester.gh (Grasshopper 0.9.72)
# plug-ins: Decodes Python Interpreter, Ants, Picnic

aworld = AntsWorld({edges="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", GenCount="3", gens="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", nodes="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", type="Dictionary", weights="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"})

# ---- group: Visualize Results
genvals = GetValues(AWorld=aworld, Generation=Slider(2, range=0..1000))

# ----
key = Data()
pg = PicnicGet(PF=genvals, Key="v")
pg_2 = PicnicGet(PF=genvals, Key="u")
pt = Point([Point(0, 0, 0), Point(1, 0, 0), Point(2, 0, 0), Point(3, 0, 0), Point(4, 0, 0), Point(5, 0, 0)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])
gradient = Gradient(LowerLimit=0, UpperLimit=1, Parameter=pg_2, stops=[0.15: RGB(255, 130, 160), 0.85: RGB(220, 0, 40)])
decodes = DecodesPythonScript(u=pg_2, v=pg, p=pt)  # -> console, a, a_props; inputs u: list, v: list, p: list
# ---------- decodes: Python ----------
corner_colors=[Color(1),Color(0),Color(1),Color(1,0,0)]
        # make sure that we are selecting within the history

# get the value fields for the specific generation
hist_u = u
hist_v = u

# define corner colors for double interpolation
u0v0, u0v1, u1v0, u1v1 = corner_colors

# initialize a grid of points to visualize the value field
points = []

# for each x-location in the value fields:
for i in range(len(u)):
    # get u and v values at x,y
    v_val = v[i]
    u_val = u[i]
    # map the u and v values onto the color space
    v_max_col_range = Color().interpolate(u1v0,u1v1,v_val**0.5)
    v_min_col_range = Color().interpolate(u0v0,u0v1,v_val**0.5)
    uv_color = Color().interpolate(v_min_col_range, v_max_col_range, u_val**0.5)
    
    # create a point and assign it the mapped color
    pt = p[i]
    pt.set_color(uv_color)
    pt.set_weight(20.0) # set the preview weight for point
    points.append(pt) # append point to list of points

a.put( points ) # return the list of points
# ---------- end decodes ----------
panel = Panel(gradient)
hardboil = DecodesHardBoil(Geometry=decodes.a, Properties=decodes.a_props)
