# Grasshopper definition internalized_worlds.gh (Grasshopper 0.9.72)
# plug-ins: Ants

# ---- group: 3x3x10G
aworld = AntsWorld({edges="0:1,3,4;1:0,2,3,4,5;2:1,4,5;3:0,1,4,6,7;4:0,1,2,3,5,6,7,8;5:1,2,4,7,8;6:3,4,7;7:3,4,5,6,8;8:4,5,7", gens="0,0,0,1,1,1,0,0,0;0,0,0,1,1,1,0,0,0;0,1,0,0,1,0,0,1,0;0,0,0,1,1,1,0,0,0;0,1,0,0,1,0,0,1,0;0,0,0,1,1,1,0,0,0;0,1,0,0,1,0,0,1,0;0,0,0,1,1,1,0,0,0;0,1,0,0,1,0,0,1,0;0,0,0,1,1,1,0,0,0;0,1,0,0,1,0,0,1,0;0,0,0,1,1,1,0,0,0", igen="0,0,0,1,1,1,0,0,0", nodes="0,0,0;1,0,0;2,0,0;0,1,0;1,1,0;2,1,0;0,2,0;1,2,0;2,2,0", weights="0,1:1;1,3:1;1,2:1;2,4:1;0,3:1;3,4:1;1,4:1;0,4:1;4,6:1;4,5:1;2,5:1;1,5:1;5,7:1;3,6:1;6,7:1;4,7:1;3,7:1;7,8:1;5,8:1;4,8:1"})

# ---- group: 30x30x200G
aworld_2 = AntsWorld({edges="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", gens="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", igen="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", nodes="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", weights="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"})

# ----
knob = ControlKnob(Decimals=0, Limit=True, Maximum=200, Minimum=0, Range=200, Value=0)
aworld_3 = AntsWorld(aworld)
aworldtograph = AntworldToGraph(AWorld=aworld_3)
genvals = GenerationValues(AWorld=aworld_3, Generation=Slider(0, range=0..10))
graphtoedges = GraphToEdges(SpatialGraph=aworldtograph)
getnodes = GraphToNodes(SpatialGraph=aworldtograph)
cir = Circle(Plane=getnodes, Radius=expr("x/2", genvals))
