# Grasshopper definition map_color.gh (Grasshopper 0.9.72)
# plug-ins: Ants

# ---- group: voronoi
number_slider = Slider(19, range=0..100)
pt = Point(Point(-20.9, -9.6, 0))
box = CenterBox(Base=pt, X=number_slider, Y=number_slider, Z=0)
pop2d = Populate2D(Region=box, Count=Slider(70, range=0..100), Seed=Slider(0.3, range=0..1))
voronoi = Voronoi(Points=pop2d, Boundary=box, BruteForceOverride=False)
geo = Data(voronoi)
crvshp = CreateGraphFromShapes(Shapes=geo, ConnectCorners=False)

# ----
geo_2 = Geometry(geo)

# ---- group: works!
number_slider_2 = Slider(6, range=0..100)
hexgrid = Hexagonal(Plane=PlaneXY(0, 0, 0), Size=1, ExtentX=number_slider_2, ExtentY=number_slider_2)  # -> flatten(Cells), flatten(Points)
geo_3 = Geometry(hexgrid.Cells)
ptsgph = CreateGraphFromPoints(Points=hexgrid.Points, Dist=Slider(1.8, range=0..10))
sg = SpatialGraph(crvshp)
number_slider_3 = Slider(9, range=0..100)
lng = ListLength(List=geo_2)
repeat = RepeatData(Data=-1, Length=lng)
gphln = GraphToEdges(SpatialGraph=sg)
replace = ReplaceItems(List=repeat, Item=0, Indices=0, Wrap=False)
gphexp = GraphExplorer(SpatialGraph=sg, IndexOfNode=number_slider_3)  # -> Points, Neighbors, Edges, Weights
panel = Panel(gphexp.Weights)
start_vals = Data(replace)

# ---- group: perform coloring
evaluation_rule = Panel("""# choose lowest color that hasn't been used

for c in range(10):
   if not(any(v == c for v in n_vals)):
      break

h_val = c

print h_val, n_wts[0], n_vals[0]""")
selection_rule = Panel("""# pick nodes that aren't colored yet but are
# adjacent to ones that are

h_val =  (h_val == -1) and any([v > -1 for v in n_vals])
print h_idx, n_vals, h_val""")
selection_rule_2 = Data(selection_rule)
eval_rule = Data(evaluation_rule)
selection_rule_3 = Data(selection_rule_2)
start_vals_2 = Data(replace)
eval_rule_2 = Data(eval_rule)
sg_2 = SpatialGraph(sg)
ants = AntsEngine2(
    SpatialGraph=sg_2,
    SelectionScript=selection_rule_3,
    OneOrAll=Toggle(True),
    EvalScript=eval_rule_2,
    Value=start_vals_2,
    Generations=expr("x-1", lng))  # -> Console, AWorld
panel_2 = Panel(ants.Console)
genvals = GenerationValues(AWorld=ants.AWorld, Generation=lng)
data = Data(genvals)
bnd = Bounds(Numbers=genvals)
panel_3 = Panel(bnd)

# ---- group: works! / doesn't work with shapes yet
crvshp_2 = CreateGraphFromShapes(Shapes=hexgrid.Cells, ConnectCorners=False)

# ----
wheel = ColourWheel(
    "6",
    ColourGrips_Style=20,
    ColourGrips_Grip=[0.9004728268, 3.010856649, 4.188790205, 3.141592654],
    ColourGrips_Lum=[0.3448411912, 1],
    ColourGrips_Range=[0.5473213087, 0.4980602818, 0.2282573991, 0.2282573991],
    ColourGrips_Sat=[0.7602333185, 0.1366360733])

# ---- group: visualize
number_slider_4 = Slider(6, range=0..10)
data_2 = Data(data)
random = Random(Range=Domain(0, 255), Number=number_slider_4, Seed=2)
random_2 = Random(Range=Domain(0, 255), Number=number_slider_4, Seed=3)
random_3 = Random(Range=Domain(0, 255), Number=number_slider_4, Seed=4)
geo_4 = Geometry(geo_2)
rgb = ColourRGB(Alpha=255, Red=random, Green=random_2, Blue=random_3)
item = ListItem(List=geo_4, Index=number_slider_3, Wrap=True)
boundary = BoundarySurfaces(Edges=item)
item_2 = ListItem(List=wheel, Index=data_2, Wrap=True)
boundary_2 = BoundarySurfaces(Edges=geo_4)
preview = CustomPreview(Geometry=boundary_2, Shader=item_2)

# ----
panel_4 = Panel(wheel)
