# Grasshopper definition new_ants_gray_scott.gh (Grasshopper 0.9.72)
# plug-ins: Python Interpreter, Decodes Python Interpreter, Ants, Picnic

select = Slider(1, range=0..500)

# ----
# a
decodes = DecodesPythonScript()  # -> console, g
# ---------- decodes: Python ----------
'''
4.02.L01a
Create a class that implements the Gray Scott Reaction-Diffusion algorithm 

members:
width, height (float) The dimensions of the rectangular boundary of the model
f, k, du, dv (float) Coefficients 

methods:
set_u (None) Sets the u-value of the model at given x,y to the given value
set_v (None) Sets the v-value of the model at given x,y to the given value
get_u (float) Gets the u-value of the model at given x,y
get_v (float) Gets the v-value of the model at given x,y
set_rect (None) Sets the values of a rectangle of a given width and height, starting at a given x,y. U-value set to .5, v-value set to .25.
clear (None) Restore all values to their defaults and clear the history.
record (None) Append the current state of the model to the history.
step (None) Creates a new generation and performs reaction-diffusion algorithm to update the model.
to_pts (points) Creates a set of points representing the state of the model at a given time
'''

"""
A type is defined that stores u and v values for each location in two value fields, records the history 
of the model as it changes, and provides methods for reading, writing and clearing values.
"""
class GrayScott (object):

    def __init__(self, dimensions=Interval(20,20)):
        
        # sets the boundary rectangle
        self.width = int(dimensions.a)
        self.height = int(dimensions.b)

        # set default coefficients
        self.f, self.k = 0.023, 0.077
        self.du, self.dv = 0.095, 0.03
        
        # resets the GrayScott object
        self.clear()
        
    """
    Methods for providing access to the u or v values stored in this GreyScott's value fields.
    Some provide access to a given pixel location, and one allows us to set values for an entire rectangular region.
    [pseudo]
    """  
    def set_u(self,x,y,val):
        # set the u pixel at coordinates x,y to the given value
        x,y = self._reframe(x,y) 
        self._uvals.set(x,y,val) 
    
    def set_v(self,x,y,val):
        # set the v pixel at coordinates x,y to the given value
        x,y = self._reframe(x,y)
        self._vvals.set(x,y,val)
        
    def get_u(self,x,y): 
        # return the value found at the u pixel at coordinates x,y
        return self._uvals.get(x,y)
    
    def get_v(self,x,y): 
        # return the value found at the v pixel at coordinates x,y
        return self._vvals.get(x,y)
    
    def set_rect(self,x,y,w,h):
        x,y,w,h = int(x),int(y),int(w),int(h)
        # for each x-location within the given rectangle:
        for xi in range(x,x+w):
            # for each y-location within the given rectangle:
            for yi in range(y,y+h):
                # set the u and v to default values.
                self.set_u(xi,yi,0.5)
                self.set_v(xi,yi,0.25)
                
    """
    [noprint]
    """
    def _reframe(self,x,y):
        # if alocation is outside the value field, move it back
        while x > self.width -1 : x = x - self.width
        while y > self.height -1: y = y - self.height
        while x < 0 : x = self.width + x
        while y < 0 : y = self.height + y
        return x,y
        
    """
    Restore all values to their defaults and clear the history.
    """
    def clear(self):
        # create new value fields for the u and v values
        self._uvals = ValueField(Interval(self.width,self.height),1.0)
        self._vvals = ValueField(Interval(self.width,self.height),0.0)
        
        # initialize the step counter variable
        self.step_count = 0
        
        # set the u and v value histories to empty lists
        self.hist_u = []
        self.hist_v = []
        
        # reset minimum and maximum recorded u and v values
        self.max_recorded_u = 0.0
        self.min_recorded_u = 1.0
        self.max_recorded_v = 0.0
        self.min_recorded_v = 1.0
        
    """
    Methods for recording the current state of the model and creating a new generation.
    """
    def record(self):
        # append u and v value fields to the history lists
        self.hist_u.append(self._uvals)
        self.hist_v.append(self._vvals)
        
    def step(self, t=1.0):
        # create a blank value field for the next generation
        nxt_uvals = ValueField(Interval(self.width,self.height),0.0)
        nxt_vvals = ValueField(Interval(self.width,self.height),0.0)
        
        # make sure that time increment is between 0.0 and 1.0
        t = max(min(1.0,t),0.0)
        
        # for each x-location in the value fields:
        for x in range(0,self.width):
            # for each y-location in the value fields:
            for y in range(0,self.height):
                # get its u and v values 
                cur_u = self._uvals.get(x,y)
                cur_v = self._vvals.get(x,y)
                
                # get its neighbors
                neighbors_u = self._uvals.neighbors_of(x,y)
                neighbors_v = self._vvals.neighbors_of(x,y)
                
                # apply the GrayScott reaction-diffusion algorithm
                d2 = cur_u * cur_v * cur_v
                cur_du = self.du * (sum(neighbors_u) - 4.0 * cur_u) - d2
                cur_dv = self.dv * (sum(neighbors_v) - 4.0 * cur_v) + d2
                nxt_u = cur_u + t * (cur_du + self.f * (1.0 - cur_u))
                nxt_v = cur_v + t * (cur_dv - self.k * cur_v)
                
                # set the values of the new value field
                nxt_uvals.set(x,y,max(0.0,nxt_u))
                nxt_vvals.set(x,y,max(0.0,nxt_v))

        # set the current grid to the new value field
        self._uvals = nxt_uvals
        self._vvals = nxt_vvals
        self.step_count += 1 # Increment the step count
        
    """
    Creates a set of points representing the state of the model at a given time.
    """
    def to_pts(self, g=0, corner_colors=[Color(1),Color(0),Color(1),Color(1,0,0)]):
        # make sure that we are selecting within the history
        select = g % len(self.hist_u)
        
        # get the value fields for the specific generation
        hist_u = self.hist_u[select]
        hist_v = self.hist_v[select]
        
        # define corner colors for double interpolation
        u0v0, u0v1, u1v0, u1v1 = corner_colors
        
        # initialize a grid of points to visualize the value field
        points = []

        # for each x-location in the value fields:
        for x in range(0,self.width):
            # for each y-location in the value fields:
            for y in range(0,self.height):
            
                # get u and v values at x,y
                v_val = hist_v.get(x,y)
                u_val = hist_u.get(x,y)
                # map the u and v values onto the color space
                v_max_col_range = Color().interpolate(u1v0,u1v1,v_val**0.5)
                v_min_col_range = Color().interpolate(u0v0,u0v1,v_val**0.5)
                uv_color = Color().interpolate(v_min_col_range, v_max_col_range, u_val**0.5)
                
                # create a point and assign it the mapped color
                pt = Point(x,y,0)
                pt.set_color(uv_color)
                pt.set_weight(20.0) # set the preview weight for point
                points.append(pt) # append point to list of points
        
        return points # return the list of points


g.put(GrayScott)
# ---------- end decodes ----------

# ----
# b
decodes_2 = DecodesPythonScript(GrayScott=decodes.g, max_gen=Slider(20, range=0..5000), stepsize=Slider(1, range=0..5000), select_step=select)  # -> console, a, a_props, b, b_props, c, c_props; inputs max_gen: Int32, stepsize: Int32, select_step: Int32
# ---------- decodes_2: Python ----------
'''
4.02.L01b
Given the GrayScott class defined in the previous example, perform the Reaction-Diffusion algorithma nd record the time history.

required:
GrayScott (Class) A Class that implements the Gray Scott Reaction-Diffusion algorithm.
max_gen (int) The number of generations for the algorithm to run.
stepsize (int) The number of generations to run before recording the state of the model.
select_step (int) The recorded step of the model to visualize.

result:
points (list of points) A list of points with color and weight set.
'''

"""
Create a GrayScott object, define test shapes, perform algorithm and visualize results.
"""

# initialize an instance of the GrayScott object class
scott = GrayScott()

# define initial rectangles
scott.set_rect(3,3,3,3)
scott.set_rect(13,13,3,2)
scott.set_rect(18,4,3,8)

# for every generation to be produced:
for n in range(max_gen):
    # if generation should be recorded:
    if n % stepsize == 0:
        # record the state of the GrayScott model
        scott.record() 

    scott.step() # update the GrayScott model

# get points from the GrayScott model for a given generation        
points = scott.to_pts(select_step)

a.put(points)

print scott.hist_u[select_step]._pixels

b.put(scott.hist_u[select_step]._pixels)
c.put(scott.hist_v[select_step]._pixels)
# ---------- end decodes_2 ----------

panel = Panel(decodes_2.c)
hardboil = DecodesHardBoil(Geometry=decodes_2.a, Properties=decodes_2.a_props)  # disabled
panel_2 = Panel(decodes_2.b)
key = Data("v")
range = Range(Domain=Domain(0, 1), Steps=10)
python = PythonScript()  # -> out, a
# ---------- python: Python ----------
import copy

def test(h_val, n_vals):
    # Example of Evaluation Code Snippet
    # Evaluates each cell per Conway's Game of Life
    # Code expects:
    #	h_val  -- the value of the home cell
    #	n_vals -- the values of the neighboring cells
    # When code has run, the value of h_val will be
    # reinserted into the value list
    
    # Set up constants and valiables
    f, k = 0.023, 0.077
    du, dv = 0.095, 0.03
    t = 1.0
    
    try:
        h_val = h_val.Value
    except:
        pass
        
    try:
        h_val["u"] = h_val["u"].Value
        h_val["v"] = h_val["v"].Value
    except:
        pass
        
    cur_u = h_val["u"]
    cur_v = h_val["v"]
    
    
    # get its neighbors
    neighbors_u = []
    neighbors_v = []


    # fix the value
    for i in range(len(n_vals)):
        try:
            n_vals[i] = n_vals[i].Value
            n_vals[i]["u"] = n_vals[i]["u"].Value
            n_vals[i]["v"] = n_vals[i]["v"].Value
        except:
            pass
    s_u = 0
    s_v = 0
    for i in range(len(n_vals)):
        s_u+=n_vals[i]["u"]
        s_v+=n_vals[i]["v"]
    
    # apply the GrayScott reaction-diffusion algorithm
    d2 = cur_u * cur_v * cur_v
    cur_du = du *(s_u - 4.0 * cur_u) - d2
    cur_dv = dv * (s_v - 4.0 * cur_v) + d2
    nxt_u = cur_u + t * (cur_du + f * (1.0 - cur_u))
    nxt_v = cur_v + t * (cur_dv - k * cur_v)

    h_val["u"] = max(0.0,nxt_u)
    h_val["v"] = max(0.0,nxt_v)
    # get its u and v values 

    return copy.deepcopy(h_val)
    
    
a = test
# ---------- end python ----------
dom²num = ConstructDomain²(UMin=0, UMax=Slider(255, range=0..1000), VMin=0, VMax=Slider(255, range=0..1000))
remap = RemapNumbers(Value=Slider(0.5, range=0..1), Source=Domain(0, 1), Target=dom²num)  # -> Mapped, Clipped
python_2 = PythonScript()  # -> out, a
# ---------- python_2: Python ----------
def test(h_val, n_vals):
    # Example of Evaluation Code Snippet
    # Evaluates each cell per Conway's Game of Life
    # Code expects:
    #	h_val  -- the value of the home cell
    #	n_vals -- the values of the neighboring cells
    # When code has run, the value of h_val will be
    # reinserted into the value list
    
    # Set up constants and valiables
    f, k = 0.023, 0.077
    du, dv = 0.095, 0.03
    t = 1.0
    
    try:
        h_val["u"] = h_val["u"].Value
        h_val["v"] = h_val["v"].Value
    except:
        pass

        # get its u and v values 
    cur_u = h_val["u"]
    cur_v = h_val["v"]
    
    # get its neighbors
    neighbors_u = []
    neighbors_v = []
    
    # fix the value
    for i in range(len(n_vals)):
        try:
            n_vals[i]["u"] = n_vals[i]["u"].Value
            n_vals[i]["v"] = n_vals[i]["v"].Value
        except:
            pass
                
    for i in range(len(n_vals)):
        neighbors_u.append(n_vals[i]["u"])
        neighbors_v.append(n_vals[i]["v"])
    
    # apply the GrayScott reaction-diffusion algorithm
    d2 = cur_u * cur_v * cur_v
    cur_du = du *(sum(neighbors_u) - 4.0 * cur_u) - d2
    cur_dv = dv * (sum(neighbors_v) - 4.0 * cur_v) + d2
    nxt_u = cur_u + t * (cur_du + f * (1.0 - cur_u))
    nxt_v = cur_v + t * (cur_dv - k * cur_v)

    h_val["u"] = cur_du
    h_val["v"] = cur_dv

    return h_val
    
    
a = test
# ---------- end python_2 ----------
panel_3 = Panel("u")
key_2 = Data(key)

# ---- group: Set up Graph
# game of life: # Example of Evaluation Code Snippet
# # Evaluates each cell per Conway's Game of Life
# # Code expects:
# #	h_val  -- the value of the home cell
# #	n_vals -- the values of the neighboring cells
# # When code has run, the value of h_val will be
# # reinserted into the value list
# 
# # Set up constants and valiables
# val_on = 1.0
# val_off = 0.0
# count = 0
# 
# # for each cell in the neighborhood:
# for i in n_vals:
#     # if cell is True:
#     if i >= val_on:
#         count += 1 # count it
# 
# # if home cell is ON:
# if h_val >= val_on:
#     # if less than 2 or more than 3 neighbors are ON:
#     if (count < 2) or (count >3) :
#         # this cell will be OFFe in the next generation
#         h_val = val_off
#     # else:
#     else:
#         # this cell will be ON in the next generation
#         h_val = val_on
# # else the home cell is OFF:
# else:
#     # if exactly 3 neighbors are ON:
#     if (count == 3):
#         # this cell will be ON in the next generation
#         h_val = val_on
#     else:
#         # else this cell will be False in the next generation
#         h_val = val_off
# 
# # Anything printed will show up in the console if
# # a panel is attached to the ... output of the Ants
# # component
# print h_val, count, n_vals
toggle = BooleanToggle(False)

# ---- group: create starting position
pixel_width = Panel("20")
pixel_height = Panel("20")
pixel_height_2 = Integer(pixel_height)
pixel_width_2 = Integer(pixel_width)

# ---- group: Set up Graph (continued)
pixel_width_3 = Integer(pixel_width)
pixel_height_3 = Integer(pixel_height)
grgph = CreateGraphOfAGrid(Rows=pixel_width_3, NumberOfColumns=pixel_height_3, ConnectCorners=toggle)
gphpts = GraphToNodes(SpatialGraph=grgph)
sg = SpatialGraph(grgph)
pt = Point(gphpts)

# ---- group: create starting position
pixel_height_4 = Integer(pixel_height)
pixel_width_4 = Integer(pixel_width)
cluster = Cluster(B_2=pixel_width_4, B=pixel_height_4)
image = ImageSampler(
    cluster,
    FilePath="C:\Users\Ned Reifenstein\Documents\GitHub\ants\gh\images\gs_01.png",
    Filter="Value",
    Interpolate=False,
    Umax=20,
    Umin=1,
    Vmax=20,
    Vmin=1,
    Wrap=1)

# ----
subtraction = Subtraction(A=image, B=1)
abs = Absolute(Value=subtraction)
division = Division(A=abs, B=2)
addition = Addition(A=division, B=image)
division_2 = Division(A=abs, B=4)
pf = PicnicFood(Key="u", Vals=addition)
panel_4 = Panel(addition)
pf_2 = PicnicFood(PF=pf, Key="v", Vals=division_2)
pg = PicnicGet(PF=pf_2, Key="v")
panel_5 = Panel(pg)

# ---- group: create starting position (continued)
bitmap = Data(pf_2)

# ----
pt_2 = Point(pt)

# ---- group: Run CA Model [ caution - takes time ]
number_slider = Slider(30, range=0..100)
life_code = Text()
sg_2 = SpatialGraph(sg)
bitmap_2 = Data(bitmap)

# ----
ants = AntsEngine(SpatialGraph=sg_2, Script=python.a, Value=bitmap_2, Generations=number_slider)  # -> Console, AWorld

# ---- group: Run CA Model [ caution - takes time ] (continued)
aworld = AntsWorld(ants.AWorld)

# ---- group: Visualize Results
aworld_2 = AntsWorld(aworld)
genvals = GetValues(AWorld=aworld_2, Generation=Slider(17, range=0..100))
pt_3 = Point(pt)
cir = Circle(Plane=pt_3, Radius=expr("x/2", genvals))

# ----
pg_2 = PicnicGet(PF=genvals, Key="v")
pg_3 = PicnicGet(PF=genvals, Key="v")
panel_6 = Panel(pg_3)
remap_2 = RemapNumbers(Value=pg_3, Source=Domain(0, 1), Target="5")  # -> Mapped, Clipped
decodes_3 = DecodesPythonScript(u=pg_3, v=pg_2, p=pt_2)  # -> console, a, a_props; inputs u: list, v: list, p: list
# ---------- decodes_3: Python ----------
corner_colors=[Color(1),Color(0),Color(1),Color(1,0,0)]
        # make sure that we are selecting within the history

# get the value fields for the specific generation
hist_u = u
hist_v = u

# define corner colors for double interpolation
u0v0, u0v1, u1v0, u1v1 = corner_colors

# initialize a grid of points to visualize the value field
points = []

# for each x-location in the value fields:
for i in range(len(u)):
    # get u and v values at x,y
    v_val = v[i]
    u_val = u[i]
    # map the u and v values onto the color space
    v_max_col_range = Color().interpolate(u1v0,u1v1,v_val**0.5)
    v_min_col_range = Color().interpolate(u0v0,u0v1,v_val**0.5)
    uv_color = Color().interpolate(v_min_col_range, v_max_col_range, u_val**0.5)
    
    # create a point and assign it the mapped color
    pt = p[i]
    pt.set_color(uv_color)
    pt.set_weight(20.0) # set the preview weight for point
    points.append(pt) # append point to list of points

a.put( points ) # return the list of points
# ---------- end decodes_3 ----------
Z = UnitZ(Factor=remap_2.Mapped)
move = Move(Geometry=pt_3, Motion=Z)  # -> Geometry, Transform
hardboil_2 = DecodesHardBoil(Geometry=decodes_3.a, Properties=decodes_3.a_props)

# ==== cluster Cluster
B = ClusterInput()
B_2 = ClusterInput()
dom = ConstructDomain(DomainStart=1, DomainEnd=B)
dom_2 = ConstructDomain(DomainStart=1, DomainEnd=B_2)
range = Range(Domain=dom, Steps=dom)
range_2 = Range(Domain=dom_2, Steps=dom_2)
crossref = CrossReference(ListA=range_2, ListB=range, CrossMode=1)  # -> ListA, ListB
pt = ConstructPoint(XCoordinate=crossref.ListA, YCoordinate=crossref.ListB, ZCoordinate=0)
pt_2 = ClusterOutput(pt)
