# Grasshopper definition new_ants_great_court_test2.ghx (Grasshopper 0.9.72)
# plug-ins: Python Interpreter, Decodes Python Interpreter, Ants

md_slider = MDSlider(
    slider_value=Point(0.5177824439, 0.5084838867, 0.5),
    SliderMode=0,
    x_domain=Domain(-2, 2),
    y_domain=Domain(-2, 2),
    z_domain=Domain(0, 1))  # disabled
height = Slider(0.6, range=-1..1.5)  # disabled
rec_h = Slider(6.5, range=1..8)
rec_w = Slider(4.6, range=1..8)
rad = Slider(0.65, range=0.1..3)
height_2 = Slider(0.6, range=-1..1.5)
rec_h_2 = Slider(6.5, range=1..8)  # disabled
rec_w_2 = Slider(4.6, range=1..8)  # disabled
rad_2 = Slider(0.65, range=0.1..3)  # disabled
rec_h_3 = Slider(6.5, range=1..8)  # disabled
rad_3 = Slider(0.65, range=0.1..3)  # disabled
rec_w_3 = Slider(4.6, range=1..8)  # disabled

# ---- group: great court roof
# c
decodes = DecodesPythonScript(rec_w=rec_w, rec_h=rec_h, rad=rad, height=height_2)  # -> console, a
# ---------- decodes: Python ----------
import math


def func1(t):
    c = math.cos(t)
    s = math.sin(t)
    pt_out = Point(rad*c, rad*s)
    return pt_out
     
def func2(t):
    c = math.cos(t)
    s = math.sin(t)
    alpha = math.atan(rec_h/rec_w)
    pi = math.pi
    pi_over_2 = 0.5*pi
    
    if (t >=0) and (t < alpha):
        l_coord = 0.5*rec_w*s/c
        pt_out = Point(rec_w/2, l_coord)
    elif (t >= alpha) and (t < pi-alpha):
        l_coord = 0.5*rec_h*c/s
        pt_out = Point(l_coord, rec_h/2)
    elif (t >= pi-alpha) and (t < pi + alpha):
        l_coord = -0.5*rec_w*s/c
        pt_out = Point(-rec_w/2, l_coord)
    elif (t >= pi + alpha) and (t < 2*pi - alpha):
        l_coord = -0.5*rec_h*c/s
        pt_out = Point(l_coord, -rec_h/2) 
    elif (t >= 2*pi-alpha) and (t <= 2*pi):
        l_coord = 0.5*rec_w*s/c
        pt_out = Point(rec_w/2, l_coord)
    else:
        print "Out-of-bounds!"   
    return pt_out
    
def func(u,v):
    pt_out = func1(u)*(1-v) + func2(u)*v 
    pt_out.z = math.sin(v*math.pi)*height
    return pt_out
      

surf = Surface(func,Interval.twopi(),Interval())
a.put(surf.to_mesh(True, True, 20,10))
# ---------- end decodes ----------
mesh = Mesh(decodes.a)

# ---- group: relaxation / mesh quads
decodes_2 = DecodesPythonScript()  # -> console, a; disabled
# ---------- decodes_2: Python ----------
in_valence = 4 # the minimum valence of a point not on the edge of the mesh.
# this value should change for square (4) and triangular (6) meshes

def mesh_neighborhood_quad(m):
    nbrhd = []
    
    for pi in range(len(m.pts)): # for each point index in our mesh
        nbrhd.append([]) #append an empty list of neighbors to hold neighbor information for this point.
        for face in m.faces: # look at each face in the mesh
            if pi in face : # if we find this point index listed in the face
                # add the two other points found in this face that are adjacent to this face
                index_in_face = face.index(pi)
                nbrhd[-1].append(face[index_in_face-1])
                if index_in_face == 3 : index_in_face = -1
                nbrhd[-1].append(face[index_in_face+1])
        nbrhd[-1] = list(set(nbrhd[-1])) # remove duplicates
        if len(nbrhd[-1]) < in_valence : 
            nbrhd[-1] = False
        
    return nbrhd

a.put(mesh_neighborhood_quad)
# ---------- end decodes_2 ----------

# ----
# a
decodes_3 = DecodesPythonScript(center=md_slider, height=height)  # -> console, a; disabled
# ---------- decodes_3: Python ----------
import math
rec_w = 4.5
rec_h = 6.5
rad = 0.8

def func1(t):
    c = math.cos(t)
    s = math.sin(t)
    pt_out = Point(rad*c, rad*s)+Vec(center)
    return pt_out
     
def func2(t):
    c = math.cos(t)
    s = math.sin(t)
    alpha = math.atan(rec_h/rec_w)
    pi = math.pi
    pi_over_2 = 0.5*pi
    
    if (t >=0) and (t < alpha):
        l_coord = 0.5*rec_w*s/c
        pt_out = Point(rec_w/2, l_coord)
    elif (t >= alpha) and (t < pi-alpha):
        l_coord = 0.5*rec_h*c/s
        pt_out = Point(l_coord, rec_h/2)
    elif (t >= pi-alpha) and (t < pi + alpha):
        l_coord = -0.5*rec_w*s/c
        pt_out = Point(-rec_w/2, l_coord)
    elif (t >= pi + alpha) and (t < 2*pi - alpha):
        l_coord = -0.5*rec_h*c/s
        pt_out = Point(l_coord, -rec_h/2) 
    elif (t >= 2*pi-alpha) and (t <= 2*pi):
        l_coord = 0.5*rec_w*s/c
        pt_out = Point(rec_w/2, l_coord)
    else:
        print "Out-of-bounds!"   
    return pt_out
    
def func(u,v):
    pt_out = func1(u)*(1-v) + func2(u)*v 
    pt_out.z = math.sin(v*math.pi)*height
    return pt_out
      

surf = Surface(func,Interval.twopi(),Interval())
a.put(surf.to_mesh(True, True, 20,10))
# ---------- end decodes_3 ----------

# ---- group: rectangle
decodes_4 = DecodesPythonScript(rec_w=rec_w_2, rec_h=rec_h_2)  # -> console, a; disabled
# ---------- decodes_4: Python ----------
import math


def func(t):
    c = math.cos(t)
    s = math.sin(t)
    alpha = math.atan(rec_h/rec_w)
    pi = math.pi
    pi_over_2 = 0.5*pi
    
    if (t >=0) and (t < alpha):
        l_coord = 0.5*rec_w*s/c
        pt_out = Point(rec_w/2, l_coord)
    elif (t >= alpha) and (t < pi-alpha):
        l_coord = 0.5*rec_h*c/s
        pt_out = Point(l_coord, rec_h/2)
    elif (t >= pi-alpha) and (t < pi + alpha):
        l_coord = -0.5*rec_w*s/c
        pt_out = Point(-rec_w/2, l_coord)
    elif (t >= pi + alpha) and (t < 2*pi - alpha):
        l_coord = -0.5*rec_h*c/s
        pt_out = Point(l_coord, -rec_h/2) 
    elif (t >= 2*pi-alpha) and (t <= 2*pi):
        l_coord = 0.5*rec_w*s/c
        pt_out = Point(rec_w/2, l_coord)
    else:
        print "Out-of-bounds!"
   
    return pt_out
     

a.put(func)
# ---------- end decodes_4 ----------

# ---- group: circle
decodes_5 = DecodesPythonScript(rad=rad_2)  # -> console, a; disabled
# ---------- decodes_5: Python ----------
import math

def func(t):
    c = math.cos(t)
    s = math.sin(t)
    pt_out = Point(rad*c, rad*s)
    return pt_out
     
a.put(func)
# ---------- end decodes_5 ----------

# ---- group: relaxation / mesh quads
decodes_6 = DecodesPythonScript()  # -> console, a; disabled; same code as decodes_2

# ---- group: relaxation / mesh tris
decodes_7 = DecodesPythonScript()  # -> console, a; disabled
# ---------- decodes_7: Python ----------
in_valence = 6 # the minimum valence of a point not on the edge of the mesh.
# this value should change for square (4) and triangular (6) meshes

def mesh_neighborhood(m):
    nbrhd = []
    for pi in range(len(m.pts)): # for each point index in our mesh
        nbrhd.append([]) #append an empty list of neighbors to hold neighbor information for this point.
        for face in m.faces: # look at each face in the mesh
            if pi in face : # if we find this point index listed in the face
                for n in range(len(face)):
                    if face[n] != pi and face[n] not in nbrhd[-1]: nbrhd[-1].append(face[n])
        if len(nbrhd[-1]) < in_valence : nbrhd[-1] = False
    return nbrhd

a.put(mesh_neighborhood)
# ---------- end decodes_7 ----------

decodes_8 = DecodesPythonScript()  # -> console, a; disabled; same code as decodes_7

# ---- group: relaxation
keep_low = Panel("3")  # disabled
decodes_9 = DecodesPythonScript(msh=mesh, func=decodes_8.a, steps=keep_low)  # -> console, a; inputs steps: Int32; disabled
# ---------- decodes_9: Python ----------
nbrhd = func(msh)# calculate mesh neighborhood

for step in range(steps): # sets the number of smoothing steps
    edge_pt_cnt = 0
    new_msh = Mesh()#create a new mesh
    for pi in range(len(msh.pts)): # for each point index in the old mesh
        if (nbrhd[pi]): # if the point is not an edge condition
             # find the centroid of all its neighboring points and add that to 
             # the new mesh in the indexed position
             neighbors = [msh.pts[n] for n in nbrhd[pi]]
             new_msh.append(Point.centroid(neighbors)) 
        else: 
            # if the point is an edge condition, add it to the new mesh
            new_msh.append(msh.pts[pi])
            edge_pt_cnt += 1
            
    for face in msh.faces: #for each face in the old mesh
        #build a new mesh face with the new point locations
        new_msh.add_face(face[0], face[1], face[2])
    msh = new_msh #overwrite the old mesh 
    
    

a.put(msh)
# ---------- end decodes_9 ----------
mesh_2 = Mesh(decodes_9.a)  # disabled

mesh_3 = Mesh(decodes_3.a)  # disabled
keep_low_2 = Panel("2")  # disabled
decodes_10 = DecodesPythonScript(msh=mesh_3, func=decodes_7.a, steps=keep_low_2)  # -> console, a; inputs steps: Int32; disabled; same code as decodes_9
mesh_4 = Mesh(decodes_10.a)  # disabled

# ----
medges = MeshEdges(Mesh=mesh)  # -> NakedEdges, InteriorEdges, NonManifoldEdges

# ---- group: tween mesh
# b
decodes_11 = DecodesPythonScript(rec_w=rec_w_3, rec_h=rec_h_3, rad=rad_3)  # -> console, a; disabled
# ---------- decodes_11: Python ----------
import math


def func1(t):
    c = math.cos(t)
    s = math.sin(t)
    pt_out = Point(rad*c, rad*s)
    return pt_out
     
def func2(t):
    c = math.cos(t)
    s = math.sin(t)
    alpha = math.atan(rec_h/rec_w)
    pi = math.pi
    pi_over_2 = 0.5*pi
    
    if (t >=0) and (t < alpha):
        l_coord = 0.5*rec_w*s/c
        pt_out = Point(rec_w/2, l_coord)
    elif (t >= alpha) and (t < pi-alpha):
        l_coord = 0.5*rec_h*c/s
        pt_out = Point(l_coord, rec_h/2)
    elif (t >= pi-alpha) and (t < pi + alpha):
        l_coord = -0.5*rec_w*s/c
        pt_out = Point(-rec_w/2, l_coord)
    elif (t >= pi + alpha) and (t < 2*pi - alpha):
        l_coord = -0.5*rec_h*c/s
        pt_out = Point(l_coord, -rec_h/2) 
    elif (t >= 2*pi-alpha) and (t <= 2*pi):
        l_coord = 0.5*rec_w*s/c
        pt_out = Point(rec_w/2, l_coord)
    else:
        print "Out-of-bounds!"
        
    return pt_out
    
def func(u,v):
    return func1(u)*(1-v) + func2(u)*v
      
surf = Surface(func,Interval.twopi(),Interval())
a.put(surf.to_mesh(True, 20,10))
# ---------- end decodes_11 ----------

# ---- group: tween
# a
decodes_12 = DecodesPythonScript(func1=decodes_5.a, func2=decodes_4.a)  # -> console, a; disabled
# ---------- decodes_12: Python ----------
import math


#Interpolates between two curves given by func1 and func2, both defined on [0,2pi]
def func(t):
    return func1(t)*(1-m) + func2(t)*m 

for m in Interval().divide(10):      
    crv_out = Curve(func,Interval(0, 2*math.pi), 0.01)
    a.put(crv_out.surrogate)
# ---------- end decodes_12 ----------

# ----
lnsgph = CreateGraphFromLines(Lines=[medges.NakedEdges, medges.InteriorEdges, medges.NonManifoldEdges])
number_slider = Slider(1, range=0..1)
gphpts = GraphToNodes(SpatialGraph=lnsgph)
gphln = GraphToEdges(SpatialGraph=lnsgph)
python = PythonScript(dz=number_slider)  # -> out, a
# ---------- python: Python ----------
from Rhino.Geometry import Point3d

def test(h_val,n_vals):
    p = h_val
        
    n_pt = []
    
    sx = 0.0
    sy = 0.0
    sz = 0.0
    
    n = len(n_vals)
    
    if n < 5:
        return h_val
    
    for i in range(n):
        n_pt.append(n_vals[i])
        sx+=n_pt[i].X
        sy+=n_pt[i].Y
        sz+=n_pt[i].Z
    
    return Point3d(sx/n, sy/n, sz/n)
    
a = test
# ---------- end python ----------
python_2 = PythonScript(dz=number_slider)  # -> out, a; disabled
# ---------- python_2: Python ----------
from Rhino.Geometry import Point3d

def test(h_val,n_vals):
    try:
        p = h_val.Value
    except:
        p = h_val
        
    n_pt = []
    
    sx = 0.0
    sy = 0.0
    sz = 0.0
    
    n = len(n_vals)
    
    if n < 5:
        return h_val
    
    for i in range(n):
        try:
            n_pt.append(n_vals[i].Value)
        except:
            n_pt.append(n_vals[i])
        sx+=n_pt[i].X
        sy+=n_pt[i].Y
        sz+=n_pt[i].Z
    
    return Point3d(sx/n, sy/n, sz/n)
    
a = test
# ---------- end python_2 ----------
gphexp = GraphExplorer(SpatialGraph=lnsgph, IndexOfNode=Slider(354, range=0..1000))  # -> Points, Neighbors, Edges, Weights
ants = AntsEngine(SpatialGraph=lnsgph, Script=python.a, Value=gphpts, Generations=Slider(20, range=0..100))  # -> Console, AWorld
sg = SpatialGraph({edges="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", nodes="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", weights="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"})
panel = Panel(ants.Console)
data = Data()
data_2 = Data()
aworld = AntsWorld({edges="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", GenCount="20", gens="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", nodes="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", type="Point3d", weights="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"})
genvals = GetValues(AWorld=ants.AWorld, Generation=Slider(1, range=0..100))
chpts = ChangeNodesOfAGraph(SpatialGraph=sg, Points=genvals)
pt = Point(genvals)
gphln_2 = GraphToEdges(SpatialGraph=chpts)
