# Grasshopper definition new_ants_life_boolean.gh (Grasshopper 0.9.72)
# plug-ins: Python Interpreter, Ants

game_of_life = Panel("""# Example of Evaluation Code Snippet
# Evaluates each cell per Conway's Game of Life
# Code expects:
#	h_val  -- the value of the home cell
#	n_vals -- the values of the neighboring cells
# When code has run, the value of h_val will be
# reinserted into the value list

# Set up constants and valiables
val_on = 1.0
val_off = 0.0
count = 0

# for each cell in the neighborhood:
for i in n_vals:
    # if cell is True:
    if i >= val_on: 
        count += 1 # count it
        
# if home cell is ON:
if h_val >= val_on:
    # if less than 2 or more than 3 neighbors are ON:
    if (count < 2) or (count >3) :
        # this cell will be OFFe in the next generation
        h_val = val_off
    # else:
    else:
        # this cell will be ON in the next generation
        h_val = val_on
# else the home cell is OFF:
else:
    # if exactly 3 neighbors are ON:
    if (count == 3):
        # this cell will be ON in the next generation
        h_val = val_on
    else:
        # else this cell will be False in the next generation
        h_val = val_off

# Anything printed will show up in the console if
# a panel is attached to the ... output of the Ants
# component
print h_val, count, n_vals""")
life_code = Text(game_of_life)
python = PythonScript()  # -> out, a
# ---------- python: Python ----------
def test(h_val, n_vals):
    # Example of Evaluation Code Snippet
    # Evaluates each cell per Conway's Game of Life
    # Code expects:
    #	h_val  -- the value of the home cell
    #	n_vals -- the values of the neighboring cells
    # When code has run, the value of h_val will be
    # reinserted into the value list
    
    # Set up constants and valiables
    val_on = True
    val_off = False
    count = 0
    try:
        h_val = h_val.Value
    except:
        pass
    

    
    # for each cell in the neighborhood:
    for i in n_vals:
        try:
            i = i.Value
        except:
            pass
        # if cell is True:
        if i == val_on: 
            count += 1 # count it
            
    # if home cell is ON:
    if h_val:
        # if less than 2 or more than 3 neighbors are ON:
        if (count < 2) or (count >3) :
            # this cell will be OFFe in the next generation
            h_val = val_off
        # else:
        else:
            # this cell will be ON in the next generation
            h_val = val_on
    # else the home cell is OFF:
    else:
        # if exactly 3 neighbors are ON:
        if (count == 3):
            # this cell will be ON in the next generation
            h_val = val_on
        else:
            # else this cell will be False in the next generation
            h_val = val_off
    
    # Anything printed will show up in the console if
    # a panel is attached to the ... output of the Ants
    # component
    print h_val, count, n_vals

    return h_val
    
    
a = test
# ---------- end python ----------
id = Guid()

# ---- group: create starting position
pixel_width = Panel("40")
pixel_height = Panel("40")
pixel_height_2 = Integer(pixel_height)
pixel_width_2 = Integer(pixel_width)

# ---- group: Set up Graph
pixel_width_3 = Integer(pixel_width)
pixel_height_3 = Integer(pixel_height)
grgph = CreateGraphOfAGrid(Rows=pixel_width_3, NumberOfColumns=pixel_height_3, ConnectCorners=Toggle(True))
gphpts = GraphToNodes(SpatialGraph=grgph)
sg = SpatialGraph(grgph)
pt = Point(gphpts)

# ---- group: create starting position
pixel_height_4 = Integer(pixel_height)
pixel_width_4 = Integer(pixel_width)
cluster = Cluster(B_2=pixel_width_4, B=pixel_height_4)
image = ImageSampler(
    cluster,
    FilePath="C:\Users\Ned Reifenstein\Documents\GitHub\decodes\sandbox\_nr_sandbox\studio\game_of_life_01_40x40.png",
    Filter="Red",
    Interpolate=False,
    Umax=40,
    Umin=1,
    Vmax=40,
    Vmin=1,
    Wrap=1)

addition = Addition(A=image, B=1)
mod = Modulus(A=addition, B=2)

# ----
smaller = SmallerThan(FirstNumber=addition, SecondNumber=2)  # -> SmallerThan, OrEqualTo

# ---- group: create starting position (continued)
bitmap = Data(smaller.SmallerThan)

# ---- group: Run CA Model [ caution - takes time ]
number_slider = Slider(44, range=0..100)
life_code_2 = Text(life_code)
sg_2 = SpatialGraph(sg)
bitmap_2 = Data(bitmap)

# ----
ants = AntsEngine(SpatialGraph=sg_2, Script=python.a, Value=bitmap_2, Generations=number_slider)  # -> Console, AWorld

# ---- group: Run CA Model [ caution - takes time ] (continued)
aworld = AntsWorld(ants.AWorld)

# ---- group: Visualize Results
aworld_2 = AntsWorld(aworld)
genvals = GetValues(AWorld=aworld_2, Generation=Slider(0, range=0..100))
pt_2 = Point(pt)

# ----
cull = CullPattern(List=pt_2, CullPattern=genvals)

# ---- group: Visualize Results (continued)
cir = Circle(Plane=cull, Radius=expr("x/2", 1))

# ==== cluster Cluster
B = ClusterInput()
B_2 = ClusterInput()
dom = ConstructDomain(DomainStart=1, DomainEnd=B)
dom_2 = ConstructDomain(DomainStart=1, DomainEnd=B_2)
range = Range(Domain=dom, Steps=dom)
range_2 = Range(Domain=dom_2, Steps=dom_2)
crossref = CrossReference(ListA=range_2, ListB=range, CrossMode=1)  # -> ListA, ListB
pt = ConstructPoint(XCoordinate=crossref.ListA, YCoordinate=crossref.ListB, ZCoordinate=0)
pt_2 = ClusterOutput(pt)
