# Grasshopper definition new_ants_life_internalized.gh (Grasshopper 0.9.72)
# plug-ins: Ants

# ---- group: Internalized
aworld = AntsWorld({Count=13, Count=1600, number=0, number=0, number=0, number=0, number=0, number=0, number=0, number=0, number=0, number=0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})

# ---- group: Visualize Results
aworld_2 = AntsWorld(aworld)
genvals = GetValues(AWorld=aworld_2, Generation=Slider(0, range=0..100))
pt = Point([Point(0, 0, 0), Point(1, 0, 0), Point(2, 0, 0), Point(3, 0, 0), Point(4, 0, 0), Point(5, 0, 0)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])
cir = Circle(Plane=pt, Radius=expr("x/2", genvals))
