# Grasshopper definition type_checker.gh (Grasshopper 0.9.72)
# plug-ins: Picnic

number_slider = Slider(4, range=0..10)
panel = Panel("test")
pop3d = Populate3D(Region={Plane=PlaneXY(0, 0, 0), X=Domain(0, 10), Y=Domain(0, 10), Z=Domain(0, 2)}, Count=Slider(2, range=0..10), Seed=1)
random = Random(Range=Domain(0, 1), Number=Slider(1, range=0..1), Seed=2)
pq = PicnicQuery(G=random)  # -> S, V
pq_2 = PicnicQuery(G=pop3d)  # -> S, V
data = Data(pq.V)
panel_2 = Panel(pq.S)
panel_3 = Panel(pq_2.S)
panel_4 = Panel(pq.V)
panel_5 = Panel(pq_2.V)
