# Grasshopper definition wolfram_ca.gh (Grasshopper 0.9.72)
# plug-ins: Decodes Python Interpreter, Ants

multiplication = Multiplication(A="6", B=2)
addition = Addition(A=multiplication, B=-1)
M = Number("6")
maze_solver = Panel("""# wolfram ca
# rule is between 0 and 255
rule = 41
t = 0
# make sure we aren't at an edge
if len(n_vals) == 8:
    print "yo"
    t = int(n_vals[0] + 2* n_vals[1] + 4*n_vals[2])

    if (rule & (2**t)) > 0:
        h_val = 1

print len(n_vals),n_vals[0],n_vals[1],n_vals[2], t, h_val""")
N = Number(addition)
N_2 = Number(N)
multiplication_2 = Multiplication(A="6", B=multiplication)
N_3 = Number(N)
M_2 = Number(M)
decodes = DecodesPythonScript()  # -> console, a
# ---------- decodes: Python ----------
b = 30
c = 2**5

print b,c,b & c
# ---------- end decodes ----------
grgph = CreateGraphOfAGrid(Rows=M_2, NumberOfColumns=N_3, ConnectCorners=Toggle(True))
number_slider = Slider(9, range=0..40)  # disabled
repeat = RepeatData(Data=0, Length=multiplication_2)
M_3 = Number(M)
func_b = Text(maze_solver)
sg = SpatialGraph(grgph)
sg_2 = SpatialGraph(sg)  # disabled
gphln = GraphToEdges(SpatialGraph=grgph)
gphpts = GraphToNodes(SpatialGraph=grgph)
replace = ReplaceItems(List=repeat, Item=1, Indices=expr("x-1", M_3), Wrap=False)
gphexp = GraphExplorer(SpatialGraph=sg_2, IndexOfNode=number_slider)  # -> Points, Neighbors, Edges, Weights; disabled
sph = Sphere(Base=gphexp.Points, Radius=0.5)  # disabled
data = Data(replace)
func_b_2 = Text(func_b)
pipe = Pipe(Curve=gphexp.Edges, Radius=0.2, Caps=0)  # disabled
panel = Panel(gphexp.Neighbors)  # disabled
panel_2 = Panel(replace)
data_2 = Data(replace)
sg_3 = SpatialGraph(sg)
panel_3 = Panel(gphexp.Weights)  # disabled
ants = AntsEngine(SpatialGraph=sg_3, Script=func_b_2, Value=data_2, Generations=Slider(30, range=0..100))  # -> Console, AWorld
panel_4 = Panel(ants.Console)
genvals = GenerationValues(AWorld=ants.AWorld, Generation=Slider(30, range=0..100))
panel_5 = Panel(genvals)
cull = CullPattern(List=gphpts, CullPattern=genvals)
circle = CircleCNR(Center=cull, Normal=Vector(0, 0, 1), Radius=0.5)
preview = CustomPreview(
    Geometry=circle,
    Shader={ambient=RGB(0, 0, 0), diffuse=RGB(255, 105, 180), emission=RGB(76, 32, 54), shine=0.5, specular=RGB(255, 255, 255), transparency=0})
