# Grasshopper definition wolfram_ca2.gh (Grasshopper 0.9.72)
# plug-ins: Ants

maze_solver = Panel("""# wolfram ca
# rule is between 0 and 255
rule = 110
t = 0
# make sure we aren't at an edge
if (len(n_vals) == 8) and ((n_vals[0]>-1) or (n_vals[1]>-1) or (n_vals[2]>-1)):
    t = 0
    h_val = 0
    if n_vals[0] == 1 : t = t+1
    if n_vals[1] == 1 : t = t+2
    if n_vals[2] == 1 : t = t+4
    # t = int(n_vals[0] + 2* n_vals[1] + 4*n_vals[2])

    if (int(rule) & (2**t)) > 0:
        h_val = 1

print len(n_vals),n_vals[0],n_vals[1],n_vals[2], t, h_val, int(rule) & (2**t)""")
multiplication = Multiplication(A="40", B=2)
addition = Addition(A=multiplication, B=-1)
M = Number("40")
N = Number(addition)
M_2 = Number(M)
M_3 = Number(M)
N_2 = Number(N)
sqgrid = Square(Plane=PlaneXY(0, 0, 0), Size=1, ExtentX=expr("x-1", M_2), ExtentY=expr("x-1", N_2))  # -> flatten(Cells), Points; disabled
N_3 = Number(N)
multiplication_2 = Multiplication(A="40", B=multiplication)
_40x80 = SpatialGraph({edges="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", nodes="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", weights="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"})
pt = Point(flatten(sqgrid.Points))
grgph = CreateGraphOfAGrid(Rows=M_2, NumberOfColumns=N_2, ConnectCorners=Toggle(True))  # disabled
crvgph = CreateGraphFromCurves(Curves=sqgrid.Cells, ConnectCorners=Toggle(True))  # disabled
number_slider = Slider(9, range=0..40)  # disabled
_100x200 = SpatialGraph({edges="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", nodes="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", weights="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"})
repeat = RepeatData(Data=-1, Length=multiplication_2)
M_4 = Number(M)
ptsgph = CreateGraphFromPoints(Points=pt, Dist=Slider(1.8, range=0..10))
func_b = Text(maze_solver)
sg = SpatialGraph(_100x200)  # disabled
gphpts = GraphToNodes(SpatialGraph=_40x80)
replace = ReplaceItems(List=repeat, Item=1, Indices=expr("x-1", M_4), Wrap=False)
gphexp = GraphExplorer(SpatialGraph=sg, IndexOfNode=number_slider)  # -> Points, Neighbors, Edges, Weights; disabled
_30x60 = SpatialGraph({edges="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", nodes="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", weights="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"})
gphln = GraphToEdges(SpatialGraph=ptsgph)
_20x40 = SpatialGraph({edges="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", nodes="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", weights="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"})
sph = Sphere(Base=gphexp.Points, Radius=0.5)  # disabled
data = Data(replace)
func_b_2 = Text(func_b)
M_5 = Number(M)
pipe = Pipe(Curve=gphexp.Edges, Radius=0.2, Caps=0)  # disabled
panel = Panel(gphexp.Neighbors)  # disabled
panel_2 = Panel(replace)
data_2 = Data(replace)
sg_2 = SpatialGraph(_40x80)
panel_3 = Panel(gphexp.Weights)  # disabled
ants = AntsEngine(SpatialGraph=sg_2, Script=func_b_2, Value=data_2, Generations=Slider(40, range=0..100))  # -> Console, AWorld
M_6 = Number(M)
panel_4 = Panel(ants.Console)
genvals = GenerationValues(AWorld=ants.AWorld, Generation=Slider(41, range=0..100))
panel_5 = Panel(genvals)
equals = Equality(FirstNumber=genvals, SecondNumber=1)  # -> Equality, Inequality
cull = CullPattern(List=gphpts, CullPattern=equals.Equality)
circle = CircleCNR(Center=cull, Normal=Vector(0, 0, 1), Radius=0.5)
box = CenterBox(Base=cull, X=0.5, Y=0.5, Z=0)
colour = ColourPicker(PickedColour=RGB(24, 0, 0))
preview = CustomPreview(Geometry=box, Shader=colour)
